# Grasshopper definition Nano_Final_1211_1417.gh (Grasshopper 0.9.76)
# plug-ins: MeshEdit Components, Kangaroo2 Components, Firefly.Core

timer = Timer(TimerInterval=1, Target=read)
number_slider = Slider(3, range=3..5)
bend_learning = BooleanToggle(False)
useaverages = BooleanToggle(True)
open_port = OpenClosePort(OpenClosePort=Toggle(False), PortNumber=number_slider, BaudRate=115200)
read = SerialReadGeneric(StartReadingValues=Toggle(True), PortNumber=number_slider)  # -> SerialOutput, StatusMessage
split = TextSplit(Text=read.SerialOutput, Separators=",")
number_slider_2 = Slider(400, range=0..1000)  # disabled
panel = Panel(open_port)
num = Number([-67, -69, -61, -63, -64, -63, -51, -47, -65, -67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])
int = Integer(split)
oldnoded = Number([-67, -69, -61, -63, -64, -63, -51, -47, -65, -67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])
# smoothing using average
# of -15 to +15 samples kills
# most noise
newnoded = Number([7, 6, 8, 8, 12, 14, 6, -4, 2, 3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])
# Create lists of randomized values for each parameter and animate a slider that steps the index for all at same time
panel_2 = Panel("15 to 45")  # disabled
panel_3 = Panel("0 to 27")  # disabled
# 0-63 bottom (red)
# 64-127 top
button = Button()
hinge = Hinge(Strength=1)  # disabled
random = Random(Range=panel_2, Number=1, Seed=number_slider_2)  # disabled
random_2 = Random(Range=panel_3, Number=1, Seed=number_slider_2)  # disabled
int_2 = Integer(random_2)  # disabled
int_3 = Integer(random)  # disabled
mesh = Mesh(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)  # disabled
demesh = DeconstructMesh(Mesh=mesh)  # -> Vertices, Faces, Colours, Normals; disabled
lng = ListLength(List=demesh.Vertices)  # disabled
division = Division(A=lng, B=2)  # disabled
random_3 = Random(Range=lng, Number=division, Seed=2, Integers=True)  # disabled
nv = NakedVertices(Mesh=mesh)  # -> ClothedIndex, NakedIndex, ClothedPts, NakedPts; disabled
panel_4 = Panel(int_3)  # disabled
item = ListItem(List=nv.NakedIndex, Index=int_2, Wrap=True)  # disabled
item_2 = ListItem(List=demesh.Vertices, Index=item, Wrap=True)  # disabled
pdecon = Deconstruct(Point=item_2)  # -> XComponent, YComponent, ZComponent; disabled
addition = Addition(A=pdecon.ZComponent, B=int_3)  # disabled
pt = ConstructPoint(XCoordinate=pdecon.XComponent, YCoordinate=pdecon.YComponent, ZCoordinate=addition)  # disabled
replace = ReplaceItems(List=demesh.Vertices, Item=pt, Indices=item, Wrap=False)  # disabled
medges = MeshEdges(Mesh=mesh)  # -> NakedEdges, InteriorEdges, NonManifoldEdges; disabled
conmesh = ConstructMesh(Vertices=replace, Faces=demesh.Faces)  # disabled
medges_2 = MeshEdges(Mesh=conmesh)  # -> NakedEdges, InteriorEdges, NonManifoldEdges; disabled
panel_5 = Panel(item)  # disabled
anchor = Anchor(Point=pt, Strength=10000)  # disabled
number_slider_3 = Slider(-19, range=-50..50)
crv = Curve([medges_2.NakedEdges, medges_2.InteriorEdges])  # disabled
crv_2 = Curve([medges.NakedEdges, medges.InteriorEdges])  # disabled
grab = Grab(On=True, Strength=1, Range=3)  # -> Grab, Anchors; disabled
pt_2 = Point([<point referenced from the Rhino model> x2])
show = Show(G=conmesh)  # disabled
length_line = LengthLine(Line=crv, Length=crv_2, Strength=10)  # disabled
number_slider_4 = Slider(0, range=0..113)  # disabled
zombiesolver = ZombieSolver(GoalObjects=[length_line, show, anchor], Threshold=0.01, Tolerance=0.01, MaxIterations=50000)  # -> I, V, O; disabled
reset = Button()  # disabled
pt_3 = ConstructPoint(XCoordinate=0, YCoordinate=100, ZCoordinate=0)  # disabled
item_3 = ListItem(List=zombiesolver.O, Index=1, Wrap=True)  # disabled
pi = Pi(Factor=1)  # disabled
pi_2 = Pi(Factor=1)  # disabled
solver = Solver(GoalObjects=[grab.Grab, show, length_line, anchor], Reset=reset, Threshold=0.01, Tolerance=0.01, On=True)  # -> I, V, O; disabled
number_slider_5 = Slider(0.75, range=0.5..0.99)  # disabled
pl = ConstructPlane(Origin=pt_3, XAxis=Vector(1, 0, 0), YAxis=Vector(0, 1, 0))  # disabled
# step size
number_slider_6 = Slider(0.01, range=0..0.02)  # disabled
demesh_2 = DeconstructMesh(Mesh=item_3)  # -> Vertices, Faces, Colours, Normals; disabled
item_4 = ListItem(List=demesh_2.Vertices, Index=number_slider_4, Wrap=True)  # disabled
pt_4 = ConstructPoint(XCoordinate=0, YCoordinate=100, ZCoordinate=0)
dam = DataDam(DataA=solver.O, BufferDelay=10000000, BufferMode=0)  # disabled
pi_3 = Pi(Factor=1)
pi_4 = Pi(Factor=1)  # disabled
pi_5 = Pi(Factor=1)
number_slider_7 = Slider(0.2, range=0..0.99)  # disabled
number_slider_8 = Slider(3, range=0..30)  # disabled
number_slider_9 = Slider(0.1, range=-1..1)  # disabled
multiplication = Multiplication(A=number_slider_9, B=pi)  # disabled
number_slider_10 = Slider(0.1, range=-1..1)  # disabled
multiplication_2 = Multiplication(A=number_slider_10, B=pi_2)  # disabled
# Max Iterations
number_slider_11 = Slider(10, range=1..100)  # disabled
c_script = CSharpScript()  # -> out, A; disabled
# ---------- c_script: C# ----------
    Mesh mesh = new Mesh();

    for(int i = 0; i < 8;i++)
    {
      for (int j = 0; j < 8;j++)
      {

        Point3d p = new Point3d(i * 10, j * 10, 0.0);

        mesh.Vertices.Add(p);
        if (i < 7 && j < 7) {
          p = new Point3d(i * 10 + 5, j * 10 + 5, 0.0);
          //mesh.Vertices.Add(p);
        }

      }
    }

    for(int i = 0; i < 7;i++)
    {
      for (int j = 0; j < 7;j++)
      {

        Point3d p = new Point3d(i * 10 + 5, j * 10 + 5, 0.0);
        mesh.Vertices.Add(p);

      }
    }

    for(int row = 0; row < 56; row += 8)
    {
      for(int col = 0; col < 7; col++)
      {
        //mesh.Faces.AddFace(i + j, i + j + 1, i + 9 + j, i + 8 + j);
        //mesh.Faces.AddFace(row + col, row + col + 1, row + 9 + col, row + 8 + col);
        // zero, one, nine, eight
        if (row < 56 && col < 7){
          mesh.Faces.AddFace(row + col, row + col + 64 - (row / 8), row + col + 1);
          mesh.Faces.AddFace(row + col, row + col + 64 - (row / 8), row + col + 8);
          mesh.Faces.AddFace(row + col + 8, row + col + 64 - (row / 8), row + col + 9);
          mesh.Faces.AddFace(row + col + 1, row + col + 64 - (row / 8), row + col + 9);
        }

      }
    }

    A = mesh;
# ---------- end c_script ----------
c_script_2 = CSharpScript(x=demesh_2.Vertices, maxA=number_slider_5, smooth=number_slider_7, steps=number_slider_8)  # -> out, A, B; inputs x: list of Point3d, maxA: Double, smooth: Double, steps: Int32; disabled
# ---------- c_script_2: C# ----------
    List<double> vCurvs = new List<double>();
    List<double> uCurvs = new List<double>();
    double uCurv = 0.0;
    double vCurv = 0.0;

    for(int i = 0; i < 8;i++)
    {
      int row = i * 8;

      for (int j = 0; j < 8;j++)
      {
        int col = j;
        if (j == 0){ // intial edge
          Vector3d leg1 = x[row + col + 1] - x[row + col];
          Vector3d leg2 = x[row + col + 2] - x[row + col + 1];
          vCurv = Vector3d.VectorAngle(leg1, leg2);
          //vCurv = vCurv / 2;
          //if
          vCurvs.Add(vCurv);
        } else if (j < 7) { // interior angles
          Vector3d leg1 = x[row + col] - x[row + col - 1];
          Vector3d leg2 = x[row + col + 1] - x[row + col];
          vCurv = Vector3d.VectorAngle(leg1, leg2);
          vCurvs.Add(vCurv);
        } else { // final edge
          Vector3d leg1 = x[row + col - 1] - x[row + col - 2];
          Vector3d leg2 = x[row + col] - x[row + col - 1];
          vCurv = Vector3d.VectorAngle(leg1, leg2);
          //vCurv = vCurv / 2;
          vCurvs.Add(vCurv);
        }

        if (i == 0){ // intial edge
          Vector3d leg1 = x[row + 8 + col] - x[row + col];
          Vector3d leg2 = x[row + 16 + col] - x[row + 8 + col];
          uCurv = Vector3d.VectorAngle(leg1, leg2);
          //uCurv = uCurv / 2;
          uCurvs.Add(uCurv);
        } else if (i < 7) { // interior angles
          Vector3d leg1 = x[row + col] - x[row - 8 + col];
          Vector3d leg2 = x[row + 8 + col] - x[row + col];
          uCurv = Vector3d.VectorAngle(leg1, leg2);
          uCurvs.Add(uCurv);
        } else { // final edge
          Vector3d leg1 = x[row - 8 + col] - x[row - 16 + col];
          Vector3d leg2 = x[row + col] - x[row - 8 + col];
          uCurv = Vector3d.VectorAngle(leg1, leg2);
          //uCurv = uCurv / 2;
          uCurvs.Add(uCurv);
        }


      }
    }


    // clamp values to -.75 to .75
    for(int i = 0; i < 64;i++) {
      if (uCurvs[i] > maxA * Math.PI){
        uCurvs[i] = maxA * Math.PI;
      }
      if (uCurvs[i] < -1 * maxA * Math.PI){
        uCurvs[i] = -1 * maxA * Math.PI;
      }
      if (vCurvs[i] > maxA * Math.PI){
        vCurvs[i] = maxA * Math.PI;
      }
      if (vCurvs[i] < -1 * maxA * Math.PI){
        vCurvs[i] = -1 * maxA * Math.PI;
      }
    }

    // smooth values
    for(int h = 0; h < steps ;h++)
    {
      for(int i = 0; i < 8;i++)
      {
        int row = i * 8;

        for (int j = 0; j < 8;j++)
        {
          int col = j;
          double tu = 0.0;
          double tv = 0.0;
          int cnt = 0;

          if (j > 0) {
            //tu += uVals[j - 1];
            tv += vCurvs[j - 1];
            tu += uCurvs[j - 1];
            cnt++;
          }

          if (j <= 6) {
            //tu += uVals[j + 1];
            tv += vCurvs[j + 1];
            tu += uCurvs[j + 1];
            cnt++;
          }

          if (row > 0) {
            tu += uCurvs[(row - 1) + j];
            tv += vCurvs[(row - 1) + j];
            cnt++;
          }

          if (row <= 6) {
            tu += uCurvs[(row + 1) + j];
            tv += vCurvs[(row + 1) + j];
            cnt++;
          }

          uCurvs[i] = ((1 - smooth) * uCurvs[i]) + (smooth * tu / cnt);
          vCurvs[i] = ((1 - smooth) * vCurvs[i]) + (smooth * tv / cnt);

        }
      }
    }



    A = vCurvs;
    B = uCurvs;
# ---------- end c_script_2 ----------
pl_2 = ConstructPlane(Origin=pt_4, XAxis=Vector(1, 0, 0), YAxis=Vector(0, 1, 0))
multiplication_3 = Multiplication(A=number_slider_6, B=pi_4)  # disabled
# step size
number_slider_12 = Slider(0.01, range=0..0.02)
mesh_2 = Mesh(c_script.A)  # disabled
pi_6 = Pi(Factor=1)
multiplication_4 = Multiplication(A=Slider(0.1, range=-1..1), B=pi_3)
multiplication_5 = Multiplication(A=Slider(0.1, range=-1..1), B=pi_5)
# Max Iterations
number_slider_13 = Slider(15, range=1..150)
num_2 = Number(c_script_2.B)  # disabled
c_script_3 = CSharpScript()  # -> out, A; disabled
# ---------- c_script_3: C# ----------
    Mesh mesh = new Mesh();

    for(int i = 0; i < 8;i++)
    {
      for (int j = 0; j < 8;j++)
      {

        Point3d p = new Point3d(i * 10, j * 10, 0.0);

        mesh.Vertices.Add(p);
        if (i < 7 && j < 7) {
          p = new Point3d(i * 10 + 5, j * 10 + 5, 0.0);
          //mesh.Vertices.Add(p);
        }

      }
    }

    for(int i = 0; i < 7;i++)
    {
      for (int j = 0; j < 7;j++)
      {

        Point3d p = new Point3d(i * 10 + 5, j * 10 + 5, 0.0);
        mesh.Vertices.Add(p);

      }
    }

    for(int row = 0; row < 56; row += 8)
    {
      for(int col = 0; col < 7; col++)
      {
        //mesh.Faces.AddFace(i + j, i + j + 1, i + 9 + j, i + 8 + j);
        //mesh.Faces.AddFace(row + col, row + col + 1, row + 9 + col, row + 8 + col);
        // zero, one, nine, eight
        if (row < 56 && col < 7){
          mesh.Faces.AddFace(row + col, row + col + 64 - (row / 8), row + col + 1);
          mesh.Faces.AddFace(row + col, row + col + 64 - (row / 8), row + col + 8);
          mesh.Faces.AddFace(row + col + 8, row + col + 64 - (row / 8), row + col + 9);
          mesh.Faces.AddFace(row + col + 1, row + col + 64 - (row / 8), row + col + 9);
        }

      }
    }
    
    string path = @"C:\Users\jim\Google Drive\MDes\Artificial Intelligence\out.csv";
    string data = "";

    foreach (double value in uVals)
    {
      data += value.ToString() + ",";
    }

    foreach (double value in vVals)
    {
      data += value.ToString() + ",";
    }


    // This text is added only once to the file.
    if (!System.IO.File.Exists(path))
    {
      // Create a file to write to.
      string createText = data + Environment.NewLine;
      System.IO.File.WriteAllText(path, createText);
    }

    // This text is always added, making the file longer over time
    // if it is not deleted.
    string appendText = data + Environment.NewLine;
    System.IO.File.AppendAllText(path, appendText);

    // Open the file to read from.
    string readText = File.ReadAllText(path);

    A = mesh;
# ---------- end c_script_3 ----------
num_3 = Number(c_script_2.A)  # disabled
multiplication_6 = Multiplication(A=number_slider_12, B=pi_6)
mesh_3 = Mesh(c_script_3.A)  # disabled
number_slider_14 = Slider(0, range=0..63)  # disabled
mesh_4 = Mesh(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)
path = FilePath("C:\Users\jim\Google Drive\MDes\Artificial Intelligence\excelout.csv")
pt_5 = ConstructPoint(XCoordinate=0, YCoordinate=100, ZCoordinate=0)  # disabled
pi_7 = Pi(Factor=1)  # disabled
pi_8 = Pi(Factor=1)  # disabled
pl_3 = ConstructPlane(Origin=pt_5, XAxis=Vector(1, 0, 0), YAxis=Vector(0, 1, 0))  # disabled
# step size
number_slider_15 = Slider(0.01, range=0..0.02)  # disabled
pi_9 = Pi(Factor=1)  # disabled
number_slider_16 = Slider(0.1, range=-1..1)  # disabled
multiplication_7 = Multiplication(A=number_slider_16, B=pi_7)  # disabled
number_slider_17 = Slider(0.1, range=-1..1)  # disabled
multiplication_8 = Multiplication(A=number_slider_17, B=pi_8)  # disabled
# Max Iterations
number_slider_18 = Slider(15, range=1..150)  # disabled
c_script_4 = CSharpScript()  # -> out, A; disabled; same code as c_script_3
multiplication_9 = Multiplication(A=number_slider_15, B=pi_9)  # disabled
mesh_5 = Mesh(c_script_4.A)  # disabled
number_slider_19 = Slider(3.1, range=0..3.1)  # disabled
path_2 = FilePath("C:\Users\jim\Google Drive\MDes\Artificial Intelligence\excelout.csv")  # disabled
mesh_6 = Mesh(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)  # disabled
Y = UnitY(Factor=1)  # disabled
number_slider_20 = Slider(-1.3, range=-3.1..3.1)  # disabled
pt_6 = Point(Point(40, 120, 0))  # disabled
X = UnitX(Factor=1)  # disabled
number_slider_21 = Slider(1.5, range=0..2)  # disabled
Z = UnitZ(Factor=1)  # disabled
rec = DataRecorder(flatten(c_script_5.sub), DataLimit=128, RecordData=True)
dam_2 = DataDam(DataA=rec, BufferDelay=10000000, BufferMode=0)
c_script_5 = CSharpScript(x=int, avg=dam_2, nodeD=num, bBool=bend_learning, avgBool=useaverages)  # -> Mesh, Strength, topVal, botVal, nDif, sub; inputs x: list of Int32, avg: list of Double, nodeD: list of Double, bBool: Boolean, avgBool: Boolean; disabled
# ---------- c_script_5: C# ----------
    List<Point3d> grid = new List<Point3d>();
    List<double> height = new List<double>();
    List<double> aheight = new List<double>();
    List<double> st = new List<double>();
    List<double> top = new List<double>();
    List<double> bottom = new List<double>();
    List<double> dif = new List<double>();
    Mesh mesh = new Mesh();
    //Mesh mesh2 = new Mesh();
    int count = 0;
    double favg = 0.0;
    double gavg = 0.0;

    for(int i = 0; i < 8;i++)
    {
      for (int j = 0; j < 8;j++)
      {
        double h = 0.0;
        double inv = 1.0;
        int c = 0;

        double f = x[64 + (i * 8) + j];
        double g = x[(i * 8) + j];

        top.Add(g);
        bottom.Add(f);

        double ch = g - f;
        dif.Add(ch);

        g = g - nodeD[(i * 8) + j]; // adjust f down to g using previously sampled differential


        if (bBool){
          h = -1 * (ch / 50);
        } else {

          //if avg of f and 4 neighbors is higher than avg of g and 4 neighbors
          // then we consider f to greater than g
          if (0 < i && i < 7 && 0 < j && j < 7){
            int fpos = 64 + (i * 8) + j;
            favg = (f + x[fpos - 1] + x[fpos + 1] + x[fpos - 8] + x[fpos + 8]) / 5;
            int gpos = (i * 8) + j;
            gavg = (g + x[gpos - 1] + x[gpos + 1] + x[gpos - 8] + x[gpos + 8]) / 5;
          }

          if (favg >= gavg + 150){
            h = f;
            inv = -1.0;

          } else {
            h = g;
            inv = -1.0;
          }
          h = h - 400;
          h = h / 100;
          h = h * 2;
        }

        aheight.Add(0.0 - h);
        if (avgBool) {h = h + avg[count];}
        st.Add(h);
        Point3d p = new Point3d(i * 2, j * 2, h * inv);
        //grid.Add(p);
        mesh.Vertices.Add(p);
        c = (int) (Math.Abs(h) * 150);
        if (c > 255) { c = 255; }
        if (c < 0) { c = 0; }
        mesh.VertexColors.Add(Color.FromArgb(255, c, 0));

        count++;
      }
    }

    for(int k = 0; k < 56;k += 8)
    {
      for(int l = 0; l < 7;l++)
      {
        mesh.Faces.AddFace(k + l, k + l + 1, k + 9 + l, k + 8 + l);
      }
    }

    //A = grid;
    Mesh = mesh;
    Strength = st;
    topVal = top;
    botVal = bottom;
    nDif = dif;
    sub = aheight;
# ---------- end c_script_5 ----------
msmooth = SmoothMesh(Mesh=c_script_5.Mesh, Strength=1, SkipNaked=True, Iterations=1)  # disabled
demesh_3 = DeconstructMesh(Mesh=msmooth)  # -> Vertices, Faces, Colours, Normals; disabled
topbotadjust = DataRecorder(c_script_5.nDif, DataLimit=64, RecordData=False)
avr = Average(Input=c_script_5.topVal)  # disabled
avr_2 = Average(Input=c_script_5.botVal)  # disabled
avr_3 = Average(Input=c_script_5.Strength)  # disabled
avr_4 = Average(Input=c_script_5.nDif)  # disabled
# height
panel_6 = Panel(avr_3)  # disabled
panel_7 = Panel(avr)  # disabled
panel_8 = Panel(avr_2)  # disabled
# Raw avg dif btw top and bot
panel_9 = Panel(avr_4)  # disabled
subtraction = Subtraction(A=avr, B=avr_2)  # disabled
panel_10 = Panel(subtraction)  # disabled
subtraction_2 = Subtraction(A=c_script_8.I, B=c_script_8.E)
rec_2 = DataRecorder(flatten(subtraction_2), DataLimit=128, RecordData=True)
dam_3 = DataDam(DataA=rec_2, BufferDelay=10000000, BufferMode=0)
c_script_6 = CSharpScript(x=int, record=Toggle(True), nodeD=dam_3, marker=button)  # -> out, A, B, C; inputs x: list of Int32, record: Boolean, nodeD: list of Double, marker: Boolean
# ---------- c_script_6: C# ----------
    if (record) {
      string path = @"C:\Users\jim\Google Drive\MDes\Artificial Intelligence\outsensors.csv";
      string data = "";
      string timeStamp = DateTime.Now.ToString("yyyyMMddHHmmssffff");
      double dif = 0.0;
      List<double> avgDif = new List<double>();

      int count = 0;
      int count2 = 0;
      for(int i = 0; i < 128;i++)
      {
        double rawVal = System.Convert.ToDouble(x[i]);
        if (count < 64){
          rawVal = 1000 - rawVal;
          avgDif.Add(rawVal - (1000 - (x[count + 64] - nodeD[count])));
        } else if (count > 63 && count2 < 64){
          rawVal = rawVal - nodeD[count2];
          rawVal = 1000 - rawVal;
          count2++;
        }
        if (i == 127){
          data += rawVal.ToString();
        } else {
          data += rawVal.ToString() + ",";
        }
        count++;
      }
      dif = avgDif.Sum() / 64;
      // get avg dif for each row


      // This text is added only once to the file.
      if (!System.IO.File.Exists(path))
      {
        // Create a file to write to.
        string createText = data + "," + timeStamp + "," + dif.ToString() + Environment.NewLine;
        System.IO.File.WriteAllText(path, createText);
      }

      // This text is always added, making the file longer over time
      // if it is not deleted.
      string appendText = data + "," + timeStamp + "," + dif.ToString() + Environment.NewLine;
      System.IO.File.AppendAllText(path, appendText);

      // Open the file to read from.
      string readText = File.ReadAllText(path);


      dif = dif * -1;

      if (dif > 0){
        dif = dif + 4;
      } else {
        dif = dif + 8;
      }



      A = data;
      B = dif;
      C = counter;
      counter++;
    } else {
      counter = 0;
      A = "not recording";
      B = 0.0;
      C = counter;
    }
# ---------- c_script_6: C# additional code ----------
  public static int counter;
  List<double> uValsOld = new List<double>();
# ---------- end c_script_6 ----------
smooth = SmoothNumbers(Numbers=c_script_6.B, SmoothDelay=500)
# CALCULATE RAW INPUT SPEED
panel_11 = Panel(c_script_6.C)
nblur = BlurNumbers(Numbers=c_script_6.B, Strength=1, Iterations=200, Lock=True, Wrap=False)
# Abs(dif) = U:V ratio (1=U, 0=V)
panel_12 = Panel(smooth)
c_script_7 = CSharpScript(x=panel_12, pts=pt_2)  # -> out, A, B, C, D; inputs x: Double, pts: list of Point3d
# ---------- c_script_7: C# ----------
    Vector3d negOrig = pts[0] - pts[1]; // from point[1] right
    Vector3d posOrig = pts[1] - pts[0]; // from point[0] left
    //double angle = 0.1;
    Vector3d unitZ = new Vector3d(0, 0, 1);
    Vector3d unitY = new Vector3d(0, 1, 0);
    List<Point3d> pOut = new List<Point3d>();
    List<Point3d> pOut2 = new List<Point3d>();
    List<Point3d> pOut3 = new List<Point3d>();
    double sign = x / Math.Abs(x);
    double absx = Math.Abs(x);
    //double q = (Math.Pow(2.718, (absx / 40)) - 1) / 10;
    double q = (-0.00428322 / -0.01509386) * (1 - Math.Pow(2.718, (+0.01509386 * absx))  ) * -1.05;
    q = q * Math.PI;
    q = q * sign;

    // take 18 steps, 4 times, one for each point location (along with its mirror)

    Point3d pOld = pts[1];
    Point3d pNext = pts[1];
    pOut.Add(pNext);
    for (int i = 0; i < 4; ++i){
      // first 18 steps only affect i = 0, second 18 affect i=1
      // if current rotation is less than
      posOrig.Rotate(q, unitY); // from list will be 3 - i
      pNext = pOld + posOrig;
      pOut.Add(pNext);
      pOld = pNext;
    }

    pOld = pts[0];
    pNext = pts[0];
    pOut2.Add(pNext);
    for (int i = 0; i < 4; ++i){
      negOrig.Rotate(q * -1, unitY); // from list will be i + 4
      pNext = pOld + negOrig;
      pOut2.Add(pNext);
      pOld = pNext;
    }

    for (int i = 4; i >= 0; --i){
      pOut3.Add(pOut[i]);
    }

    for (int i = 0; i < 5; ++i){
      pOut3.Add(pOut2[i]);
    }

    A = posOrig; // from point[0] right
    B = negOrig; // from point[1] left
    C = pOut3;
    D = q;
# ---------- end c_script_7 ----------
panel_13 = Panel(c_script_7.D)
pt_7 = Point(c_script_7.C)
rec_3 = DataRecorder(flatten(c_script_8.D), DataLimit=128, RecordData=True)
dam_4 = DataDam(DataA=rec_3, BufferDelay=10000000, BufferMode=0)
rec_4 = DataRecorder(flatten(c_script_8.E), DataLimit=128, RecordData=True)
dam_5 = DataDam(DataA=rec_4, BufferDelay=10000000, BufferMode=0)
c_script_8 = CSharpScript(x=int, nodeD=dam_3, avgT=dam_4, avgB=dam_5, avgBool=Toggle(True))  # -> out, A, B, C, D, E, F, G, H, I; inputs x: list of Int32, nodeD: list of Double, avgT: list of Double, avgB: list of Double, avgBool: Boolean
# ---------- c_script_8: C# ----------
    List<double> top = new List<double>();
    List<double> bottom = new List<double>();
    List<double> dif = new List<double>();
    List<double> avgTop = new List<double>();
    List<double> avgTopRaw = new List<double>();
    List<double> avgBottom = new List<double>();
    List<double> uOut = new List<double>();
    List<double> vOut = new List<double>();

    Mesh mesh = new Mesh();


    for(int i = 0; i < 8;i++)
    {
      for (int j = 0; j < 8;j++)
      {

        double t = x[64 + (i * 8) + j];
        avgTopRaw.Add(t);
        t = t - nodeD[(i * 8) + j]; // adjust f down to g using previously sampled differential
        double b = x[(i * 8) + j];

        avgTop.Add(t);
        avgBottom.Add(b);

        double difTemp = t - b;
        double difOut = 0.0;
        double sign = difTemp / Math.Abs(difTemp);
        double magnitude = 0.0;

        if (avgBool) {
          t = t - avgT[(i * 8) + j];
          top.Add(t);
          b = b - avgB[(i * 8) + j];
          bottom.Add(b);
          difTemp = t - b + 0.00001;
          sign = difTemp / Math.Abs(difTemp);
          if (Math.Abs(t) + 0.00001 > Math.Abs(b) + 0.00001) {
            magnitude = Math.Abs(t);
          } else {
            magnitude = Math.Abs(b);
          }
          difOut = magnitude * sign;

        } else {
          top.Add(t);
          bottom.Add(b);
          difTemp = t - b + 0.00001;
          sign = difTemp / Math.Abs(difTemp);
          difTemp = t * sign;
        }

        double Ucurv = sign * (Math.Abs(difTemp) / 100) * magnitude;
        uOut.Add(Ucurv / 100);
        double Vcurv = sign * (1 - Math.Abs(difTemp) / 100) * magnitude;
        vOut.Add(Vcurv / 100);
        // should also use neighbors trick, test which is better
        //need to write out sensor vals

        dif.Add(difOut);

        double h = difOut / 10;

        int c = 0;

        Point3d p = new Point3d(i * 10, j * 10, h);
        //grid.Add(p);
        mesh.Vertices.Add(p);
        c = (int) (Math.Abs(h) * 50);
        if (c > 255) { c = 255; }
        if (c < 0) { c = 0; }
        mesh.VertexColors.Add(Color.FromArgb(255, c, 0));


      }
    }

    for(int k = 0; k < 56;k += 8)
    {
      for(int l = 0; l < 7;l++)
      {
        mesh.Faces.AddFace(k + l, k + l + 1, k + 9 + l, k + 8 + l);
      }
    }




    A = top;
    B = bottom;
    C = dif;
    D = avgTop;
    E = avgBottom;
    F = mesh;
    G = uOut;
    H = vOut;
    I = avgTopRaw;
# ---------- end c_script_8 ----------
# 25 = 0.1pi
# 100 = 1pi
# (handled
# by CPT)
msmooth_2 = SmoothMesh(Mesh=c_script_8.F, Strength=1, SkipNaked=False, Iterations=1)
panel_14 = Panel(c_script_8.C)
avr_5 = Average(Input=c_script_8.C)
panel_15 = Panel(avr_5)
panel_16 = Panel(c_script_8.D)
# top
panel_17 = Panel(c_script_8.A)
avr_6 = Average(Input=c_script_8.A)
panel_18 = Panel(avr_6)
panel_19 = Panel(c_script_8.E)
# bottom (red)
panel_20 = Panel(c_script_8.B)
avr_7 = Average(Input=c_script_8.B)
panel_21 = Panel(avr_7)
uvals = Number(c_script_8.G)  # disabled
vvals = Number(c_script_8.H)  # disabled
c_script_9 = CSharpScript(origin=pl, vVals=uvals, uVals=vvals, x=number_slider_11, step=multiplication_3)  # -> out, A, B, C, D, E, F, G, H; inputs origin: Point3d, vVals: list of Double, uVals: list of Double, x: Int32, step: Double; disabled
# ---------- c_script_9: C# ----------
    double gridSize = 10.0;

    // initialize fake u v curvature values
    //List<double> vVals = new List<double>();
    //List<double> uVals = new List<double>();
    //for(int i = 0; i < 64; ++i) {
      //vVals.Add(vVal); // from slider
      //uVals.Add(uVal); // from slider
    //}

    List<double> vValsOrig = new List<double>(vVals);
    List<double> uValsOrig = new List<double>(uVals);

    // surface function creates a plane at each grid point as if fabric is perfectly stretchable
    List<Plane> planes = surface(gridSize, origin, vVals, uVals);
    // devcost function calculates how much the surface violates developability, in terms of distances squared
    double devCost = devcost(planes, gridSize);
    // SIcost function calculates penalty for each self-intersection (10,000 points per violation)
    double SIcost = intersectcost(uVals, vVals);
    double angleCost = 0.0;

    double cost = devCost + SIcost + angleCost;

    //double step = 0.01 * Math.PI;

    double count = 0.0;

    //double tempout = 0.0;

    double runningCost = 99999999.0;
    double threshold = 2.0;

    // Gradient Descent to minimize violation of developability and self-intersection
    for(int h = 0; h < x; ++h) {
      if (runningCost < threshold) {
        break;
      }
      for(int i = 0; i < 64; ++i) {
        // perturb u and v by 0.1*PI in both directions and calculate cost reduction, modify uVals/vVals with the winner
        // in other words, perform gradient descent on uVals and vVals
        List<double> tempUvals = new List<double>(uVals);
        List<double> tempUvals2 = new List<double>(uVals);
        List<double> uValsClone = new List<double>(uVals);
        List<double> uValsClone2 = new List<double>(uVals);

        tempUvals[i] = uValsClone[i] - step;
        List<Plane> planesTemp = surface(gridSize, origin, vVals, tempUvals);
        double devCostTemp = devcost(planesTemp, gridSize);
        double SIcostTemp = intersectcost(tempUvals, vVals);
        double angleCostTemp = Math.Pow(Math.Abs(uValsOrig.Sum() - tempUvals.Sum()), 2);
        double costTemp = devCostTemp + SIcostTemp + angleCostTemp;

        tempUvals2[i] = uValsClone2[i] + step;
        List<Plane> planesTemp2 = surface(gridSize, origin, vVals, tempUvals2);
        double devCostTemp2 = devcost(planesTemp2, gridSize);
        double SIcostTemp2 = intersectcost(tempUvals2, vVals);
        double angleCostTemp2 = Math.Pow(Math.Abs(uValsOrig.Sum() - tempUvals2.Sum()), 2);
        double costTemp2 = devCostTemp2 + SIcostTemp2 + angleCostTemp2;

        if (costTemp < costTemp2) {
          if (costTemp < cost){
            uVals = new List<double>(tempUvals);
            runningCost = costTemp;
            count++;
          }
        } else if (costTemp2 < cost) {
          uVals = new List<double>(tempUvals2);
          runningCost = costTemp2;
          count++;
        }

        // perturb u and v by 0.1*PI in both directions and calculate cost reduction, modify uVals/vVals with the winner
        // in other words, perform gradient descent on uVals and vVals
        List<double> tempVvals = new List<double>(vVals);
        List<double> tempVvals2 = new List<double>(vVals);
        List<double> vValsClone = new List<double>(vVals);
        List<double> vValsClone2 = new List<double>(vVals);

        tempVvals[i] = vValsClone[i] - step;
        planesTemp = surface(gridSize, origin, tempVvals, uVals);
        devCostTemp = devcost(planesTemp, gridSize);
        SIcostTemp = intersectcost(uVals, tempVvals);
        angleCostTemp = Math.Pow(Math.Abs(vValsOrig.Sum() - tempVvals.Sum()), 2);
        costTemp = devCostTemp + SIcostTemp + angleCostTemp;

        tempVvals2[i] = vValsClone2[i] + step;
        planesTemp2 = surface(gridSize, origin, tempVvals2, uVals);
        devCostTemp2 = devcost(planesTemp2, gridSize);
        SIcostTemp2 = intersectcost(uVals, tempVvals2);
        angleCostTemp2 = Math.Pow(Math.Abs(vValsOrig.Sum() - tempVvals2.Sum()), 2);
        costTemp2 = devCostTemp2 + SIcostTemp2 + angleCostTemp2;

        if (costTemp < costTemp2) {
          if (costTemp < cost){
            vVals = new List<double>(tempVvals);
            runningCost = costTemp;
            count++;
          }
        } else  if (costTemp2 < cost) {
          vVals = new List<double>(tempVvals2);
          runningCost = costTemp2;
          count++;
        }

      }
    }


    List<Plane> planesOut = surface(gridSize, origin, vVals, uVals);
    double devCostNew = devcost(planesOut, gridSize);
    double SIcostNew = intersectcost(uVals, vVals);

    A = planesOut;
    B = SIcost;
    C = devCost;
    D = SIcostNew;
    E = devCostNew;
    F = uVals;
    G = vVals;
    H = planes;
# ---------- c_script_9: C# additional code ----------
  public static List<Plane> surface(double gridSize, Point3d origin, List<double> vVals, List<double> uVals)
  {
    Vector3d v = new Vector3d(gridSize, 0, 0); // v offset
    Vector3d u = new Vector3d(0, gridSize, 0); // u offset
    Vector3d z = new Vector3d(0, 0, 1); // normal z for origin plane
    // Point3d "origin" is instantiated as input
    Plane plane = new Plane(origin, z); // plane at "origin"

    Vector3d localU = new Vector3d(u);
    Vector3d localV = new Vector3d(v);

    // current state init
    Point3d pC = new Point3d(0, 0, 0);
    Plane planeC = new Plane(origin, z);
    Vector3d vectorC = new Vector3d(v);
    Vector3d vectorCU = new Vector3d(u);
    Transform motion = Transform.Translation(v);

    // next state init
    Point3d pNV = new Point3d(0, 0, 0);
    Plane planeNV = new Plane(origin, z);
    Vector3d vectorNV = new Vector3d(0, 0, 0);
    Point3d pNU = new Point3d(0, 0, 0);
    Plane planeNU = new Plane(origin, z);
    Vector3d vectorNU = new Vector3d(0, 0, 0);
    Plane planeUtemp = new Plane(origin, z);
    Plane planeVtemp = new Plane(origin, z);

    // output init
    List<Plane> planes = new List<Plane>();
    List<Plane> planes2 = new List<Plane>();
    for(int i = 0; i < 64; ++i) {
      Plane ptemp = new Plane(origin, z);
      planes.Add(ptemp);
    }
    // planes.Add(plane); // add origin plane
    //planes[0] = plane;

    //int j = 0;

    for(int i = 0; i < 8; ++i) {



      planeNV = planeC;
      pNV = pC + vectorC;
      vectorNV = pNV - pC;
      vectorNV.Rotate(vVals[i], planeC.YAxis);
      motion = Transform.Translation(vectorNV);
      if (i > 0){
        planeNV.Transform(motion);
        pNV.Transform(motion);
        planeNV.Rotate(vVals[i], planeC.YAxis);
      }
      planes[i] = planeNV;

      // reset current vars
      planeC = planeNV;
      vectorC = vectorNV;
      pC = pNV;

    }

    //double tempout = 0.0;
    //double tempout2 = 0.0;
    Vector3d tempvec = new Vector3d(0, 0, 0);
    Plane tempplane1 = new Plane(origin, z);
    Plane tempplane2 = new Plane(origin, z);
    Plane tempplane3 = new Plane(origin, z);
    Point3d pTemp = new Point3d(0, 0, 0);

    for(int j = 0; j < 7; j++) {

      // reset current to planes[i] for each row
      vectorC = new Vector3d(v);

      if (j == 0){
        pC = planes[j * 8].Origin;
        planeC = planes[j * 8];
        vectorCU = u;
      } else {
        pC = planes[j * 8].Origin;
        planeC = planes[j * 8];
        vectorCU = planeC.Origin - planes[((j - 1) * 8)].Origin;
      }

      for(int i = 0; i < 8; ++i) {

        // create new plane in u
        planeNU = planeC;
        Plane planeCU = planeC;
        pNU = pC + vectorCU;
        vectorNU = pNU - pC;
        vectorNU.Rotate(uVals[(j * 8) + 8 + i], planeC.XAxis);
        motion = Transform.Translation(vectorNU);
        planeNU.Transform(motion);
        pNU.Transform(motion);
        planeNU.Rotate(uVals[(j * 8) + 8 + i], planeC.XAxis);
        planes[(j * 8) + 8 + i] = planeNU;

        // reconcile with previous, if no previous skip
        if (i == 0){
          //do nothing
        }else{
          //previous is [7+i]
          // do v extension from previous
          vectorC = planes[(j * 8) + 7 + i].Origin - planes[(j * 8) + 6 + i].Origin; // skipping 0, still true? --> needs to be vector in v prior, which doesn't exist
          planeC = planes[(j * 8) + 6 + i];
          pC = planeC.Origin;

          planeNV = planes[(j * 8) + 7 + i];
          pNV = pC + vectorC;
          vectorNV = pNV - pC;
          vectorNV.Rotate(vVals[(j * 8) + 8 + i], planeC.YAxis);
          motion = Transform.Translation(vectorNV);
          planeNV.Transform(motion);
          pNV.Transform(motion);
          planeNV.Rotate(vVals[(j * 8) + 8 + i], planeC.YAxis);
          planeVtemp = planeNV;


          // find midpoint (should be more constrained...) btwn plane[8 + i] and planeVtemp

          Vector3d tween = planes[(j * 8) + 8 + i].Origin - planeVtemp.Origin;
          tween = tween * 0.5;
          motion = Transform.Translation(tween);
          planes[(j * 8) + 8 + i].Transform(motion);

        }

        // reset current plane to next plane along v

        planeC = planes[(j * 8) + i + 1];
        pC = planes[(j * 8) + i + 1].Origin;
        if (j == 0) {
          vectorCU = u;
        } else {
          vectorCU = planeC.Origin - planes[((j - 1) * 8) + i + 1].Origin;
        }

      }

    }

    return planes;
  }

  public static double devcost(List<Plane> planes, double gridSize)
  {
    double globalCost = 0.0;
    //double gridSize = 10.0;

    for(int j = 1; j < 8; ++j) {

      for(int i = 1; i < 8; ++i) {

        Plane topright = planes[(j * 8) + i];
        Plane topleft = planes[(j * 8) + i - 1];
        Plane bottomleft = planes[((j - 1) * 8) + i - 1];
        Plane bottomright = planes[((j - 1) * 8) + i];

        double top = (topright.Origin - topleft.Origin).Length;
        double left = (topleft.Origin - bottomleft.Origin).Length;
        double right = (topright.Origin - bottomright.Origin).Length;
        double bottom = (bottomright.Origin - bottomleft.Origin).Length;
        double diag1 = (topleft.Origin - bottomright.Origin).Length;
        double diag2 = (topright.Origin - bottomleft.Origin).Length;

        double localCost = 0.0;
        localCost += Math.Abs(gridSize - top);
        localCost += Math.Abs(gridSize - left);
        localCost += Math.Abs(gridSize - right);
        localCost += Math.Abs(gridSize - bottom);
        double diagCost1 = Math.Abs(Math.Sqrt(2 * Math.Pow(gridSize, 2)) - diag1);
        double diagCost2 = Math.Abs(Math.Sqrt(2 * Math.Pow(gridSize, 2)) - diag2);
        if (diagCost1 < diagCost2) {
          localCost += diagCost1;
        } else {
          localCost += diagCost2;
        }

        // square the local cost
        globalCost += Math.Pow(localCost, 2);


      }

    }
    globalCost = globalCost / 49;

    return globalCost;
  }

  public static double intersectcost(List<double> uVals, List<double> vVals)
  {
    double SIcost = 0.0;
    for(int j = 0; j < 8; ++j) {
      for(int i = 0; i < 8; ++i) {
        // i how many we can look back
        int count = 0;
        double total = 0.0;
        for (int h = 1; h <= i; ++h) {

          total += vVals[(j * 8) + i - h] / Math.PI;
          if (count > 0) {
            if (Math.Abs(total) > 2 - (2 / (count + 1))) {
              SIcost += Math.Pow(total * 10, 2);
              break;
            }
          }
          count++;

        }
      }
    }

    // calculate self-intersection penalty in v direction
    for(int j = 0; j < 8; ++j) {
      for(int i = 0; i < 8; ++i) {
        // i how many we can look back
        int count = 0;
        double total = 0.0;
        for (int h = 1; h <= i; ++h) {

          total += uVals[((i - h) * 8) + j] / Math.PI;
          if (count > 0) {
            if (Math.Abs(total) > 2 - (2 / (count + 1))) {
              SIcost += Math.Pow(total * 10, 2);
              break;
            }
          }
          count++;

        }
      }
    }

    return SIcost;
  }
# ---------- end c_script_9 ----------
uvals_2 = Number(c_script_8.G)
vvals_2 = Number(c_script_8.H)
c_script_10 = CSharpScript(origin=pl_2, vVals=uvals_2, uVals=vvals_2, x=number_slider_13, step=multiplication_6)  # -> out, A, B, C, D, E, F, G, H, J; inputs origin: Point3d, vVals: list of Double, uVals: list of Double, x: Int32, step: Double; disabled
# ---------- c_script_10: C# ----------
    double gridSize = 10.0;

    // initialize fake u v curvature values
    //List<double> vVals = new List<double>();
    //List<double> uVals = new List<double>();
    //for(int i = 0; i < 64; ++i) {
    //vVals.Add(vVal); // from slider
    //uVals.Add(uVal); // from slider
    //}

    List<double> vValsOrig = new List<double>(vVals);
    List<double> uValsOrig = new List<double>(uVals);


    // surface function creates a plane at each grid point as if fabric is perfectly stretchable
    List<Plane> planes = surface(gridSize, origin, vVals, uVals);
    // devcost function calculates how much the surface violates developability, in terms of distances squared
    double devCost = devcost(planes, gridSize);
    // SIcost function calculates penalty for each self-intersection (10,000 points per violation)
    double SIcost = intersectcost(uVals, vVals);
    double angleCost = 0.0;

    double cost = devCost + SIcost + angleCost;

    //double step = 0.01 * Math.PI;

    double count = 0.0;

    //double tempout = 0.0;

    double runningCost = 99999999.0;
    double threshold = 5.0;

    // Gradient Descent to minimize violation of developability and self-intersection
    for(int h = 0; h < x; ++h) {
      if (runningCost < threshold) {
        break;
      }
      for(int i = 0; i < 64; ++i) {
        // perturb u and v by 0.1*PI in both directions and calculate cost reduction, modify uVals/vVals with the winner
        // in other words, perform gradient descent on uVals and vVals
        List<double> tempUvals = new List<double>(uVals);
        List<double> tempUvals2 = new List<double>(uVals);
        List<double> uValsClone = new List<double>(uVals);
        List<double> uValsClone2 = new List<double>(uVals);

        tempUvals[i] = uValsClone[i] - step;
        List<Plane> planesTemp = surface(gridSize, origin, vVals, tempUvals);
        double devCostTemp = devcost(planesTemp, gridSize);
        double SIcostTemp = intersectcost(tempUvals, vVals);
        double angleCostTemp = 40 * Math.Pow(Math.Abs(uValsOrig.Sum() - tempUvals.Sum()), 2);
        double costTemp = devCostTemp + SIcostTemp + angleCostTemp;

        tempUvals2[i] = uValsClone2[i] + step;
        List<Plane> planesTemp2 = surface(gridSize, origin, vVals, tempUvals2);
        double devCostTemp2 = devcost(planesTemp2, gridSize);
        double SIcostTemp2 = intersectcost(tempUvals2, vVals);
        double angleCostTemp2 = 40 * Math.Pow(Math.Abs(uValsOrig.Sum() - tempUvals2.Sum()), 2);
        double costTemp2 = devCostTemp2 + SIcostTemp2 + angleCostTemp2;

        if (costTemp < costTemp2) {
          if (costTemp < cost){
            uVals = new List<double>(tempUvals);
            runningCost = costTemp;
            count++;
          }
        } else if (costTemp2 < cost) {
          uVals = new List<double>(tempUvals2);
          runningCost = costTemp2;
          count++;
        }

        // perturb u and v by 0.1*PI in both directions and calculate cost reduction, modify uVals/vVals with the winner
        // in other words, perform gradient descent on uVals and vVals
        List<double> tempVvals = new List<double>(vVals);
        List<double> tempVvals2 = new List<double>(vVals);
        List<double> vValsClone = new List<double>(vVals);
        List<double> vValsClone2 = new List<double>(vVals);

        tempVvals[i] = vValsClone[i] - step;
        planesTemp = surface(gridSize, origin, tempVvals, uVals);
        devCostTemp = devcost(planesTemp, gridSize);
        SIcostTemp = intersectcost(uVals, tempVvals);
        angleCostTemp = 40 * Math.Pow(Math.Abs(vValsOrig.Sum() - tempVvals.Sum()), 2);
        costTemp = devCostTemp + SIcostTemp + angleCostTemp;

        tempVvals2[i] = vValsClone2[i] + step;
        planesTemp2 = surface(gridSize, origin, tempVvals2, uVals);
        devCostTemp2 = devcost(planesTemp2, gridSize);
        SIcostTemp2 = intersectcost(uVals, tempVvals2);
        angleCostTemp2 = 40 * Math.Pow(Math.Abs(vValsOrig.Sum() - tempVvals2.Sum()), 2);
        costTemp2 = devCostTemp2 + SIcostTemp2 + angleCostTemp2;

        if (costTemp < costTemp2) {
          if (costTemp < cost){
            vVals = new List<double>(tempVvals);
            runningCost = costTemp;
            count++;
          }
        } else  if (costTemp2 < cost) {
          vVals = new List<double>(tempVvals2);
          runningCost = costTemp2;
          count++;
        }

      }
    }


    List<Plane> planesOut = surface(gridSize, origin, vVals, uVals);
    double devCostNew = devcost(planesOut, gridSize);
    double SIcostNew = intersectcost(uVals, vVals);

    string path = @"C:\Users\jim\Google Drive\MDes\Artificial Intelligence\out.csv";
    string data = "";

    foreach (double value in uVals)
    {

      data += value.ToString() + ",";
    }

    foreach (double value in vVals)
    {
      data += value.ToString() + ",";
    }

    data += devCostNew.ToString() + ",";
    data += SIcostNew.ToString() + ",";


    // This text is added only once to the file.
    if (!System.IO.File.Exists(path))
    {
      // Create a file to write to.
      string createText = data + Environment.NewLine;
      System.IO.File.WriteAllText(path, createText);
    }

    // This text is always added, making the file longer over time
    // if it is not deleted.
    string appendText = data + Environment.NewLine;
    System.IO.File.AppendAllText(path, appendText);

    // Open the file to read from.
    string readText = File.ReadAllText(path);

    counter++;

    A = planesOut;
    B = SIcost;
    C = devCost;
    D = SIcostNew;
    E = devCostNew;
    F = uVals;
    G = vVals;
    H = planes;
    J = counter;
# ---------- c_script_10: C# additional code ----------
  public static double counter;
  List<double> uValsOld = new List<double>();

  public static List<Plane> surface(double gridSize, Point3d origin, List<double> vVals, List<double> uVals)
  {
    //vVals[0] = 0.0;
    //uVals[0] = 0.0;
    Vector3d v = new Vector3d(gridSize, 0, 0); // v offset
    Vector3d u = new Vector3d(0, gridSize, 0); // u offset
    Vector3d z = new Vector3d(0, 0, 1); // normal z for origin plane
    // Point3d "origin" is instantiated as input
    Plane plane = new Plane(origin, z); // plane at "origin"

    Vector3d localU = new Vector3d(u);
    Vector3d localV = new Vector3d(v);

    // current state init
    Point3d pC = new Point3d(0, 0, 0);
    Plane planeC = new Plane(origin, z);
    Vector3d vectorC = new Vector3d(v);
    Vector3d vectorCU = new Vector3d(u);
    Transform motion = Transform.Translation(v);

    // next state init
    Point3d pNV = new Point3d(0, 0, 0);
    Plane planeNV = new Plane(origin, z);
    Vector3d vectorNV = new Vector3d(0, 0, 0);
    Point3d pNU = new Point3d(0, 0, 0);
    Plane planeNU = new Plane(origin, z);
    Vector3d vectorNU = new Vector3d(0, 0, 0);
    Plane planeUtemp = new Plane(origin, z);
    Plane planeVtemp = new Plane(origin, z);

    // output init
    List<Plane> planes = new List<Plane>();
    List<Plane> planes2 = new List<Plane>();
    for(int i = 0; i < 64; ++i) {
      Plane ptemp = new Plane(origin, z);
      planes.Add(ptemp);
    }
    // planes.Add(plane); // add origin plane
    //planes[0] = plane;

    //int j = 0;

    for(int i = 0; i < 8; ++i) {



      planeNV = planeC;
      pNV = pC + vectorC;
      vectorNV = pNV - pC;
      vectorNV.Rotate(vVals[i], planeC.YAxis);
      motion = Transform.Translation(vectorNV);
      if (i > 0){
        planeNV.Transform(motion);
        pNV.Transform(motion);
        planeNV.Rotate(vVals[i], planeC.YAxis);
      }
      planes[i] = planeNV;

      // reset current vars
      planeC = planeNV;
      vectorC = vectorNV;
      pC = pNV;

    }

    //double tempout = 0.0;
    //double tempout2 = 0.0;
    Vector3d tempvec = new Vector3d(0, 0, 0);
    Plane tempplane1 = new Plane(origin, z);
    Plane tempplane2 = new Plane(origin, z);
    Plane tempplane3 = new Plane(origin, z);
    Point3d pTemp = new Point3d(0, 0, 0);

    for(int j = 0; j < 7; j++) {

      // reset current to planes[i] for each row
      vectorC = new Vector3d(v);

      if (j == 0){
        pC = planes[j * 8].Origin;
        planeC = planes[j * 8];
        vectorCU = u;
      } else {
        pC = planes[j * 8].Origin;
        planeC = planes[j * 8];
        vectorCU = planeC.Origin - planes[((j - 1) * 8)].Origin;
      }

      for(int i = 0; i < 8; ++i) {

        // create new plane in u
        planeNU = planeC;
        Plane planeCU = planeC;
        pNU = pC + vectorCU;
        vectorNU = pNU - pC;
        vectorNU.Rotate(uVals[(j * 8) + 8 + i], planeC.XAxis);
        motion = Transform.Translation(vectorNU);
        planeNU.Transform(motion);
        pNU.Transform(motion);
        planeNU.Rotate(uVals[(j * 8) + 8 + i], planeC.XAxis);
        planes[(j * 8) + 8 + i] = planeNU;

        // reconcile with previous, if no previous skip
        if (i == 0){
          //do nothing
        }else{
          //previous is [7+i]
          // do v extension from previous
          vectorC = planes[(j * 8) + 7 + i].Origin - planes[(j * 8) + 6 + i].Origin; // skipping 0, still true? --> needs to be vector in v prior, which doesn't exist
          planeC = planes[(j * 8) + 6 + i];
          pC = planeC.Origin;

          planeNV = planes[(j * 8) + 7 + i];
          pNV = pC + vectorC;
          vectorNV = pNV - pC;
          vectorNV.Rotate(vVals[(j * 8) + 8 + i], planeC.YAxis);
          motion = Transform.Translation(vectorNV);
          planeNV.Transform(motion);
          pNV.Transform(motion);
          planeNV.Rotate(vVals[(j * 8) + 8 + i], planeC.YAxis);
          planeVtemp = planeNV;


          // find midpoint (should be more constrained...) btwn plane[8 + i] and planeVtemp

          Vector3d tween = planes[(j * 8) + 8 + i].Origin - planeVtemp.Origin;
          tween = tween * 0.5;
          motion = Transform.Translation(tween);
          planes[(j * 8) + 8 + i].Transform(motion);

        }

        // reset current plane to next plane along v

        planeC = planes[(j * 8) + i + 1];
        pC = planes[(j * 8) + i + 1].Origin;
        if (j == 0) {
          vectorCU = u;
        } else {
          vectorCU = planeC.Origin - planes[((j - 1) * 8) + i + 1].Origin;
        }

      }

    }

    return planes;
  }

  public static double devcost(List<Plane> planes, double gridSize)
  {
    double globalCost = 0.0;
    //double gridSize = 10.0;

    for(int j = 1; j < 8; ++j) {

      for(int i = 1; i < 8; ++i) {

        Plane topright = planes[(j * 8) + i];
        Plane topleft = planes[(j * 8) + i - 1];
        Plane bottomleft = planes[((j - 1) * 8) + i - 1];
        Plane bottomright = planes[((j - 1) * 8) + i];

        double top = (topright.Origin - topleft.Origin).Length;
        double left = (topleft.Origin - bottomleft.Origin).Length;
        double right = (topright.Origin - bottomright.Origin).Length;
        double bottom = (bottomright.Origin - bottomleft.Origin).Length;
        double diag1 = (topleft.Origin - bottomright.Origin).Length;
        double diag2 = (topright.Origin - bottomleft.Origin).Length;

        double localCost = 0.0;
        localCost += Math.Abs(gridSize - top);
        localCost += Math.Abs(gridSize - left);
        localCost += Math.Abs(gridSize - right);
        localCost += Math.Abs(gridSize - bottom);
        double diagCost1 = Math.Abs(Math.Sqrt(2 * Math.Pow(gridSize, 2)) - diag1);
        double diagCost2 = Math.Abs(Math.Sqrt(2 * Math.Pow(gridSize, 2)) - diag2);
        if (diagCost1 < diagCost2) {
          localCost += diagCost1;
        } else {
          localCost += diagCost2;
        }

        // square the local cost
        globalCost += Math.Pow(localCost, 2);


      }

    }
    globalCost = globalCost / 49;

    return globalCost;
  }

  public static double intersectcost(List<double> uVals, List<double> vVals)
  {
    double SIcost = 0.0;
    for(int j = 0; j < 8; ++j) {
      for(int i = 0; i < 8; ++i) {
        // i how many we can look back
        int count = 0;
        double total = 0.0;
        for (int h = 1; h <= i; ++h) {

          total += vVals[(j * 8) + i - h] / Math.PI;
          if (count > 0) {
            if (Math.Abs(total) > 2 - (2 / (count + 1)) - 0.2 ) {
              SIcost += Math.Pow(total * 10, 2);
              break;
            }
          }
          count++;

        }
      }
    }

    // calculate self-intersection penalty in v direction
    for(int j = 0; j < 8; ++j) {
      for(int i = 0; i < 8; ++i) {
        // i how many we can look back
        int count = 0;
        double total = 0.0;
        for (int h = 1; h <= i; ++h) {

          total += uVals[((i - h) * 8) + j] / Math.PI;
          if (count > 0) {
            if (Math.Abs(total) > 2 - (2 / (count + 1)) - 0.2 ) {
              SIcost += Math.Pow(total * 10, 2);
              break;
            }
          }
          count++;

        }
      }
    }

    return SIcost;
  }
# ---------- end c_script_10 ----------
panel_22 = Panel(c_script_9.C)  # disabled
panel_23 = Panel(c_script_9.D)  # disabled
panel_24 = Panel(c_script_9.B)  # disabled
panel_25 = Panel(c_script_9.E)  # disabled
item_5 = ListItem(List=c_script_9.A, Index=number_slider_14, Wrap=True)  # disabled
pln = Plane(c_script_9.A)  # disabled
pln_2 = Plane(c_script_9.H)  # disabled
panel_26 = Panel(c_script_10.C)
panel_27 = Panel(c_script_10.B)
panel_28 = Panel(c_script_10.D)
panel_29 = Panel(c_script_10.E)
frompoints = MeshFromPoints(Points=c_script_10.A, UDirection=8, VDirection=8)
uvals_3 = Number(c_script_8.G)  # disabled
vvals_3 = Number(c_script_8.H)  # disabled
c_script_11 = CSharpScript(origin=pl_3, vVals=uvals_3, uVals=vvals_3, x=number_slider_18, step=multiplication_9)  # -> out, A, B, C, D, E, F, G, H; inputs origin: Point3d, vVals: list of Double, uVals: list of Double, x: Int32, step: Double; disabled
# ---------- c_script_11: C# ----------
    double gridSize = 10.0;

    // initialize fake u v curvature values
    //List<double> vVals = new List<double>();
    //List<double> uVals = new List<double>();
    //for(int i = 0; i < 64; ++i) {
    //vVals.Add(vVal); // from slider
    //uVals.Add(uVal); // from slider
    //}

    List<double> vValsOrig = new List<double>(vVals);
    List<double> uValsOrig = new List<double>(uVals);


    // surface function creates a plane at each grid point as if fabric is perfectly stretchable
    List<Plane> planes = surface(gridSize, origin, vVals, uVals);
    // devcost function calculates how much the surface violates developability, in terms of distances squared
    double devCost = devcost(planes, gridSize);
    // SIcost function calculates penalty for each self-intersection (10,000 points per violation)
    double SIcost = intersectcost(uVals, vVals);
    double angleCost = 0.0;

    double cost = devCost + SIcost + angleCost;

    //double step = 0.01 * Math.PI;

    double count = 0.0;

    //double tempout = 0.0;

    double runningCost = 99999999.0;
    double threshold = 5.0;

    // Gradient Descent to minimize violation of developability and self-intersection
    for(int h = 0; h < x; ++h) {
      if (runningCost < threshold) {
        break;
      }
      for(int i = 0; i < 64; ++i) {
        // perturb u and v by 0.1*PI in both directions and calculate cost reduction, modify uVals/vVals with the winner
        // in other words, perform gradient descent on uVals and vVals
        List<double> tempUvals = new List<double>(uVals);
        List<double> tempUvals2 = new List<double>(uVals);
        List<double> uValsClone = new List<double>(uVals);
        List<double> uValsClone2 = new List<double>(uVals);

        tempUvals[i] = uValsClone[i] - step;
        List<Plane> planesTemp = surface(gridSize, origin, vVals, tempUvals);
        double devCostTemp = devcost(planesTemp, gridSize);
        double SIcostTemp = intersectcost(tempUvals, vVals);
        double angleCostTemp = 40 * Math.Pow(Math.Abs(uValsOrig.Sum() - tempUvals.Sum()), 2);
        double costTemp = devCostTemp + SIcostTemp + angleCostTemp;

        tempUvals2[i] = uValsClone2[i] + step;
        List<Plane> planesTemp2 = surface(gridSize, origin, vVals, tempUvals2);
        double devCostTemp2 = devcost(planesTemp2, gridSize);
        double SIcostTemp2 = intersectcost(tempUvals2, vVals);
        double angleCostTemp2 = 40 * Math.Pow(Math.Abs(uValsOrig.Sum() - tempUvals2.Sum()), 2);
        double costTemp2 = devCostTemp2 + SIcostTemp2 + angleCostTemp2;

        if (costTemp < costTemp2) {
          if (costTemp < cost){
            uVals = new List<double>(tempUvals);
            runningCost = costTemp;
            count++;
          }
        } else if (costTemp2 < cost) {
          uVals = new List<double>(tempUvals2);
          runningCost = costTemp2;
          count++;
        }

        // perturb u and v by 0.1*PI in both directions and calculate cost reduction, modify uVals/vVals with the winner
        // in other words, perform gradient descent on uVals and vVals
        List<double> tempVvals = new List<double>(vVals);
        List<double> tempVvals2 = new List<double>(vVals);
        List<double> vValsClone = new List<double>(vVals);
        List<double> vValsClone2 = new List<double>(vVals);

        tempVvals[i] = vValsClone[i] - step;
        planesTemp = surface(gridSize, origin, tempVvals, uVals);
        devCostTemp = devcost(planesTemp, gridSize);
        SIcostTemp = intersectcost(uVals, tempVvals);
        angleCostTemp = 40 * Math.Pow(Math.Abs(vValsOrig.Sum() - tempVvals.Sum()), 2);
        costTemp = devCostTemp + SIcostTemp + angleCostTemp;

        tempVvals2[i] = vValsClone2[i] + step;
        planesTemp2 = surface(gridSize, origin, tempVvals2, uVals);
        devCostTemp2 = devcost(planesTemp2, gridSize);
        SIcostTemp2 = intersectcost(uVals, tempVvals2);
        angleCostTemp2 = 40 * Math.Pow(Math.Abs(vValsOrig.Sum() - tempVvals2.Sum()), 2);
        costTemp2 = devCostTemp2 + SIcostTemp2 + angleCostTemp2;

        if (costTemp < costTemp2) {
          if (costTemp < cost){
            vVals = new List<double>(tempVvals);
            runningCost = costTemp;
            count++;
          }
        } else  if (costTemp2 < cost) {
          vVals = new List<double>(tempVvals2);
          runningCost = costTemp2;
          count++;
        }

      }
    }


    List<Plane> planesOut = surface(gridSize, origin, vVals, uVals);
    double devCostNew = devcost(planesOut, gridSize);
    double SIcostNew = intersectcost(uVals, vVals);

    string path = @"C:\Users\jim\Google Drive\MDes\Artificial Intelligence\out.csv";
    string data = "";

    foreach (double value in uVals)
    {

      data += value.ToString() + ",";
    }

    foreach (double value in vVals)
    {
      data += value.ToString() + ",";
    }

    data += devCostNew.ToString() + ",";
    data += SIcostNew.ToString() + ",";


    // This text is added only once to the file.
    if (!System.IO.File.Exists(path))
    {
      // Create a file to write to.
      string createText = data + Environment.NewLine;
      System.IO.File.WriteAllText(path, createText);
    }

    // This text is always added, making the file longer over time
    // if it is not deleted.
    string appendText = data + Environment.NewLine;
    System.IO.File.AppendAllText(path, appendText);

    // Open the file to read from.
    string readText = File.ReadAllText(path);



    A = planesOut;
    B = SIcost;
    C = devCost;
    D = SIcostNew;
    E = devCostNew;
    F = uVals;
    G = vVals;
    H = planes;
# ---------- c_script_11: C# additional code ----------
  public static List<Plane> surface(double gridSize, Point3d origin, List<double> vVals, List<double> uVals)
  {
    Vector3d v = new Vector3d(gridSize, 0, 0); // v offset
    Vector3d u = new Vector3d(0, gridSize, 0); // u offset
    Vector3d z = new Vector3d(0, 0, 1); // normal z for origin plane
    // Point3d "origin" is instantiated as input
    Plane plane = new Plane(origin, z); // plane at "origin"

    Vector3d localU = new Vector3d(u);
    Vector3d localV = new Vector3d(v);

    // current state init
    Point3d pC = new Point3d(0, 0, 0);
    Plane planeC = new Plane(origin, z);
    Vector3d vectorC = new Vector3d(v);
    Vector3d vectorCU = new Vector3d(u);
    Transform motion = Transform.Translation(v);

    // next state init
    Point3d pNV = new Point3d(0, 0, 0);
    Plane planeNV = new Plane(origin, z);
    Vector3d vectorNV = new Vector3d(0, 0, 0);
    Point3d pNU = new Point3d(0, 0, 0);
    Plane planeNU = new Plane(origin, z);
    Vector3d vectorNU = new Vector3d(0, 0, 0);
    Plane planeUtemp = new Plane(origin, z);
    Plane planeVtemp = new Plane(origin, z);

    // output init
    List<Plane> planes = new List<Plane>();
    List<Plane> planes2 = new List<Plane>();
    for(int i = 0; i < 64; ++i) {
      Plane ptemp = new Plane(origin, z);
      planes.Add(ptemp);
    }
    // planes.Add(plane); // add origin plane
    //planes[0] = plane;

    //int j = 0;

    for(int i = 0; i < 8; ++i) {



      planeNV = planeC;
      pNV = pC + vectorC;
      vectorNV = pNV - pC;
      vectorNV.Rotate(vVals[i], planeC.YAxis);
      motion = Transform.Translation(vectorNV);
      if (i > 0){
        planeNV.Transform(motion);
        pNV.Transform(motion);
        planeNV.Rotate(vVals[i], planeC.YAxis);
      }
      planes[i] = planeNV;

      // reset current vars
      planeC = planeNV;
      vectorC = vectorNV;
      pC = pNV;

    }

    //double tempout = 0.0;
    //double tempout2 = 0.0;
    Vector3d tempvec = new Vector3d(0, 0, 0);
    Plane tempplane1 = new Plane(origin, z);
    Plane tempplane2 = new Plane(origin, z);
    Plane tempplane3 = new Plane(origin, z);
    Point3d pTemp = new Point3d(0, 0, 0);

    for(int j = 0; j < 7; j++) {

      // reset current to planes[i] for each row
      vectorC = new Vector3d(v);

      if (j == 0){
        pC = planes[j * 8].Origin;
        planeC = planes[j * 8];
        vectorCU = u;
      } else {
        pC = planes[j * 8].Origin;
        planeC = planes[j * 8];
        vectorCU = planeC.Origin - planes[((j - 1) * 8)].Origin;
      }

      for(int i = 0; i < 8; ++i) {

        // create new plane in u
        planeNU = planeC;
        Plane planeCU = planeC;
        pNU = pC + vectorCU;
        vectorNU = pNU - pC;
        vectorNU.Rotate(uVals[(j * 8) + 8 + i], planeC.XAxis);
        motion = Transform.Translation(vectorNU);
        planeNU.Transform(motion);
        pNU.Transform(motion);
        planeNU.Rotate(uVals[(j * 8) + 8 + i], planeC.XAxis);
        planes[(j * 8) + 8 + i] = planeNU;

        // reconcile with previous, if no previous skip
        if (i == 0){
          //do nothing
        }else{
          //previous is [7+i]
          // do v extension from previous
          vectorC = planes[(j * 8) + 7 + i].Origin - planes[(j * 8) + 6 + i].Origin; // skipping 0, still true? --> needs to be vector in v prior, which doesn't exist
          planeC = planes[(j * 8) + 6 + i];
          pC = planeC.Origin;

          planeNV = planes[(j * 8) + 7 + i];
          pNV = pC + vectorC;
          vectorNV = pNV - pC;
          vectorNV.Rotate(vVals[(j * 8) + 8 + i], planeC.YAxis);
          motion = Transform.Translation(vectorNV);
          planeNV.Transform(motion);
          pNV.Transform(motion);
          planeNV.Rotate(vVals[(j * 8) + 8 + i], planeC.YAxis);
          planeVtemp = planeNV;


          // find midpoint (should be more constrained...) btwn plane[8 + i] and planeVtemp

          Vector3d tween = planes[(j * 8) + 8 + i].Origin - planeVtemp.Origin;
          tween = tween * 0.5;
          motion = Transform.Translation(tween);
          planes[(j * 8) + 8 + i].Transform(motion);

        }

        // reset current plane to next plane along v

        planeC = planes[(j * 8) + i + 1];
        pC = planes[(j * 8) + i + 1].Origin;
        if (j == 0) {
          vectorCU = u;
        } else {
          vectorCU = planeC.Origin - planes[((j - 1) * 8) + i + 1].Origin;
        }

      }

    }

    return planes;
  }

  public static double devcost(List<Plane> planes, double gridSize)
  {
    double globalCost = 0.0;
    //double gridSize = 10.0;

    for(int j = 1; j < 8; ++j) {

      for(int i = 1; i < 8; ++i) {

        Plane topright = planes[(j * 8) + i];
        Plane topleft = planes[(j * 8) + i - 1];
        Plane bottomleft = planes[((j - 1) * 8) + i - 1];
        Plane bottomright = planes[((j - 1) * 8) + i];

        double top = (topright.Origin - topleft.Origin).Length;
        double left = (topleft.Origin - bottomleft.Origin).Length;
        double right = (topright.Origin - bottomright.Origin).Length;
        double bottom = (bottomright.Origin - bottomleft.Origin).Length;
        double diag1 = (topleft.Origin - bottomright.Origin).Length;
        double diag2 = (topright.Origin - bottomleft.Origin).Length;

        double localCost = 0.0;
        localCost += Math.Abs(gridSize - top);
        localCost += Math.Abs(gridSize - left);
        localCost += Math.Abs(gridSize - right);
        localCost += Math.Abs(gridSize - bottom);
        double diagCost1 = Math.Abs(Math.Sqrt(2 * Math.Pow(gridSize, 2)) - diag1);
        double diagCost2 = Math.Abs(Math.Sqrt(2 * Math.Pow(gridSize, 2)) - diag2);
        if (diagCost1 < diagCost2) {
          localCost += diagCost1;
        } else {
          localCost += diagCost2;
        }

        // square the local cost
        globalCost += Math.Pow(localCost, 2);


      }

    }
    globalCost = globalCost / 49;

    return globalCost;
  }

  public static double intersectcost(List<double> uVals, List<double> vVals)
  {
    double SIcost = 0.0;
    for(int j = 0; j < 8; ++j) {
      for(int i = 0; i < 8; ++i) {
        // i how many we can look back
        int count = 0;
        double total = 0.0;
        for (int h = 1; h <= i; ++h) {

          total += vVals[(j * 8) + i - h] / Math.PI;
          if (count > 0) {
            if (Math.Abs(total) > 2 - (2 / (count + 1)) - 0.2 ) {
              SIcost += Math.Pow(total * 10, 2);
              break;
            }
          }
          count++;

        }
      }
    }

    // calculate self-intersection penalty in v direction
    for(int j = 0; j < 8; ++j) {
      for(int i = 0; i < 8; ++i) {
        // i how many we can look back
        int count = 0;
        double total = 0.0;
        for (int h = 1; h <= i; ++h) {

          total += uVals[((i - h) * 8) + j] / Math.PI;
          if (count > 0) {
            if (Math.Abs(total) > 2 - (2 / (count + 1)) - 0.2 ) {
              SIcost += Math.Pow(total * 10, 2);
              break;
            }
          }
          count++;

        }
      }
    }

    return SIcost;
  }
# ---------- end c_script_11 ----------
panel_30 = Panel(c_script_11.C)  # disabled
panel_31 = Panel(c_script_11.B)  # disabled
panel_32 = Panel(c_script_11.D)  # disabled
panel_33 = Panel(c_script_11.E)  # disabled
frompoints_2 = MeshFromPoints(Points=c_script_11.A, UDirection=8, VDirection=8)  # disabled
rot3d = Rotate3D(Geometry=frompoints_2, Angle=number_slider_19, Center=pt_6, Axis=Y)  # -> Geometry, Transform; disabled
rot3d_2 = Rotate3D(Geometry=rot3d.Geometry, Angle=number_slider_20, Center=pt_6, Axis=X)  # -> Geometry, Transform; disabled
rot3d_3 = Rotate3D(Geometry=rot3d_2.Geometry, Angle=number_slider_21, Center=pt_6, Axis=Z)  # -> Geometry, Transform; disabled
