# Grasshopper definition Nano_Final_1204_0320.gh (Grasshopper 0.9.76)
# plug-ins: Firefly.Core

mesh = Mesh(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)  # disabled
nums = CSharpScript()  # -> A; disabled
# ---------- nums: C# ----------
    List<int> list = new List<int>();
    Random rnd = new Random();

    for(int i = 0; i < 64;++i){
      list.Add(i);
    }
    A = list;
# ---------- end nums ----------
mesh_2 = Mesh(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)  # disabled
nums_2 = CSharpScript()  # -> A; disabled
# ---------- nums_2: C# ----------
    List<double> list = new List<double>();
    Random rnd = new Random();

    for(int i = 0; i < 64;++i){
      list.Add(1-(rnd.NextDouble()/2));
    }
    A = list;
# ---------- end nums_2 ----------
c_script = CSharpScript()  # -> A, B, C, D, E, F; inputs x: list of Point3d, y: tree of Point3d, z: list of Double; disabled
# ---------- c_script: C# ----------
    //List<Line> lines = new List<Line>();
    double zMin = z.Min();
    var normalizedList = z.Select(i => Math.Abs(i) / 5).ToList();

    List<Point3d> p0 = new List<Point3d>();
    List<Point3d> p1 = new List<Point3d>();
    List<Point3d> p2 = new List<Point3d>();
    List<Point3d> p3 = new List<Point3d>();
    List<double> strength = new List<double>();

    for(int i = 0; i < y.BranchCount; ++i){ // 64 Branches, 1 for each vertex
      for(int j = 0; j < y.Branch(i).Count; ++j){ // each branc has neighbors, between 2 and 4

        if(y.Branch(i).Count == 4){
          /*
          Line temp1 = new Line(y.Branch(i)[0], x[i]);
          Line temp2 = new Line(x[i], y.Branch(i)[2]);
          Line temp3 = new Line(y.Branch(i)[1], x[i]);
          Line temp4 = new Line(x[i], y.Branch(i)[3]);
          lines.Add(temp1);
          lines.Add(temp2);
          lines.Add(temp3);
          lines.Add(temp4);
          */

          p0.Add(y.Branch(i)[0]);
          p1.Add(y.Branch(i)[2]);
          p2.Add(y.Branch(i)[1]);
          p3.Add(y.Branch(i)[3]);

          strength.Add(z[i]);

        }
      }
    }
    //A = lines;
    B = normalizedList;
    C = p0;
    D = p1;
    E = p2;
    F = p3;
# ---------- end c_script ----------
number_slider = Slider(0.1, range=-1..1)  # disabled

toggle = BooleanToggle(True)  # disabled
timer = Timer(TimerInterval=20)  # disabled

crv = Curve(c_script.A)  # disabled
springsfrommesh = SpringsFromMesh(M=mesh_2, stiffness=1000, B=1)  # disabled
avr = Average(Input=c_script.B)  # disabled
pi = Pi(Factor=number_slider)  # disabled
bnd = Bounds(Numbers=c_script.B)  # disabled
timer_2 = Timer(TimerInterval=1, Target=read)
number_slider_2 = Slider(3, range=3..5)
mesh_3 = Mesh()  # disabled
bend_learning = BooleanToggle(False)
useaverages = BooleanToggle(True)
open_port = OpenClosePort(OpenClosePort=Toggle(False), PortNumber=number_slider_2, BaudRate=115200)
read = SerialReadGeneric(StartReadingValues=Toggle(True), PortNumber=number_slider_2)  # -> SerialOutput, StatusMessage
split = TextSplit(Text=read.SerialOutput, Separators=",")
panel = Panel(open_port)
num = Number([-67, -69, -61, -63, -64, -63, -51, -47, -65, -67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])
int = Integer(split)
num_2 = Number([-67, -69, -61, -63, -64, -63, -51, -47, -65, -67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])
rec = DataRecorder(flatten(c_script_2.sub), DataLimit=128, RecordData=True)
dam = DataDam(DataA=rec, BufferDelay=10000000, BufferMode=0)
c_script_2 = CSharpScript(x=int, avg=dam, nodeD=num, bBool=bend_learning, avgBool=useaverages)  # -> Mesh, Strength, topVal, botVal, nDif, sub; inputs x: list of Int32, avg: list of Double, nodeD: list of Double, bBool: Boolean, avgBool: Boolean
# ---------- c_script_2: C# ----------
    List<Point3d> grid = new List<Point3d>();
    List<double> height = new List<double>();
    List<double> aheight = new List<double>();
    List<double> st = new List<double>();
    List<double> top = new List<double>();
    List<double> bottom = new List<double>();
    List<double> dif = new List<double>();
    Mesh mesh = new Mesh();
    //Mesh mesh2 = new Mesh();
    int count = 0;
    double favg = 0.0;
    double gavg = 0.0;

    for(int i = 0; i < 8;i++)
    {
      for (int j = 0; j < 8;j++)
      {
        double h = 0.0;
        double inv = 1.0;
        int c = 0;

        double f = x[64 + (i * 8) + j];
        double g = x[(i * 8) + j];

        top.Add(g);
        bottom.Add(f);

        double ch = g - f;
        dif.Add(ch);

        g = g - nodeD[(i * 8) + j]; // adjust f down to g using previously sampled differential


        if (bBool){
          h = -1 * (ch / 50);
        } else {

          //if avg of f and 4 neighbors is higher than avg of g and 4 neighbors
          // then we consider f to greater than g
          if (0 < i && i < 7 && 0 < j && j < 7){
            int fpos = 64 + (i * 8) + j;
            favg = (f + x[fpos - 1] + x[fpos + 1] + x[fpos - 8] + x[fpos + 8]) / 5;
            int gpos = (i * 8) + j;
            gavg = (g + x[gpos - 1] + x[gpos + 1] + x[gpos - 8] + x[gpos + 8]) / 5;
          }

          if (favg >= gavg + 150){
            h = f;
            inv = -1.0;

          } else {
            h = g;
            inv = -1.0;
          }
          h = h - 400;
          h = h / 100;
          h = h * 2;
        }

        aheight.Add(0.0 - h);
        if (avgBool) {h = h + avg[count];}
        st.Add(h);
        Point3d p = new Point3d(i * 2, j * 2, h * inv);
        //grid.Add(p);
        mesh.Vertices.Add(p);
        c = (int) (Math.Abs(h) * 150);
        if (c > 255) { c = 255; }
        if (c < 0) { c = 0; }
        mesh.VertexColors.Add(Color.FromArgb(255, c, 0));

        count++;
      }
    }

    for(int k = 0; k < 56;k += 8)
    {
      for(int l = 0; l < 7;l++)
      {
        mesh.Faces.AddFace(k + l, k + l + 1, k + 9 + l, k + 8 + l);
      }
    }

    //A = grid;
    Mesh = mesh;
    Strength = st;
    topVal = top;
    botVal = bottom;
    nDif = dif;
    sub = aheight;
# ---------- end c_script_2 ----------
msmooth = SmoothMesh(Mesh=c_script_2.Mesh, Strength=1, SkipNaked=True, Iterations=1)
demesh = DeconstructMesh(Mesh=msmooth)  # -> Vertices, Faces, Colours, Normals
topbotadjust = DataRecorder(c_script_2.nDif, DataLimit=64, RecordData=False)
avr_2 = Average(Input=c_script_2.topVal)  # disabled
avr_3 = Average(Input=c_script_2.botVal)  # disabled
avr_4 = Average(Input=c_script_2.Strength)  # disabled
avr_5 = Average(Input=c_script_2.nDif)  # disabled
# height
panel_2 = Panel(avr_4)  # disabled
panel_3 = Panel(avr_2)  # disabled
panel_4 = Panel(avr_3)  # disabled
# Raw avg dif btw top and bot
panel_5 = Panel(avr_5)  # disabled
subtraction = Subtraction(A=avr_2, B=avr_3)  # disabled
panel_6 = Panel(subtraction)  # disabled
rec_2 = DataRecorder(flatten(c_script_3.D), DataLimit=128, RecordData=True)
dam_2 = DataDam(DataA=rec_2, BufferDelay=10000000, BufferMode=0)
rec_3 = DataRecorder(flatten(c_script_3.E), DataLimit=128, RecordData=True)
dam_3 = DataDam(DataA=rec_3, BufferDelay=10000000, BufferMode=0)
c_script_3 = CSharpScript(x=int, nodeD=num_2, avgT=dam_2, avgB=dam_3, avgBool=Toggle(True))  # -> out, A, B, C, D, E, F; inputs x: list of Int32, nodeD: list of Double, avgT: list of Double, avgB: list of Double, avgBool: Boolean
# ---------- c_script_3: C# ----------
    List<double> top = new List<double>();
    List<double> bottom = new List<double>();
    List<double> dif = new List<double>();
    List<double> avgTop = new List<double>();
    List<double> avgBottom = new List<double>();
    Mesh mesh = new Mesh();


    for(int i = 0; i < 8;i++)
    {
      for (int j = 0; j < 8;j++)
      {

        double t = x[64 + (i * 8) + j];
        t = t - nodeD[(i * 8) + j]; // adjust f down to g using previously sampled differential
        //t = 1000 - t;
        double b = x[(i * 8) + j];
        avgTop.Add(t);
        avgBottom.Add(b);

        double difTemp = t - b;
        double difOut = 0.0;
        double sign = difTemp / Math.Abs(difTemp);
        double magnitude = 0.0;

        if (avgBool) {
          t = t - avgT[(i * 8) + j];
          top.Add(t);
          b = b - avgB[(i * 8) + j];
          bottom.Add(b);
          difTemp = t - b + 0.00001;
          sign = difTemp / Math.Abs(difTemp);
          if (Math.Abs(t) + 0.00001 > Math.Abs(b) + 0.00001) {
            magnitude = Math.Abs(t);
          } else {
            magnitude = Math.Abs(b);
          }
          difOut = magnitude * sign;

        } else {
          top.Add(t);
          bottom.Add(b);
          difTemp = t - b + 0.00001;
          sign = difTemp / Math.Abs(difTemp);
          difTemp = t * sign;
        }

        // Ucurv = sign * (Math.Abs(difTemp)/100) * magnitude
        // Vcurv = sign * (1 - Math.Abs(difTemp)/100) * magnitude  
        // should also use neighbors trick, test which is better
        
        //need to write out sensor vals and UV curvatures

        dif.Add(difOut);

        double h = difOut / 10;

        int c = 0;

        Point3d p = new Point3d(i * 10, j * 10, h);
        //grid.Add(p);
        mesh.Vertices.Add(p);
        c = (int) (Math.Abs(h) * 50);
        if (c > 255) { c = 255; }
        if (c < 0) { c = 0; }
        mesh.VertexColors.Add(Color.FromArgb(255, c, 0));


      }
    }

    for(int k = 0; k < 56;k += 8)
    {
      for(int l = 0; l < 7;l++)
      {
        mesh.Faces.AddFace(k + l, k + l + 1, k + 9 + l, k + 8 + l);
      }
    }




    A = top;
    B = bottom;
    C = dif;
    D = avgTop;
    E = avgBottom;
    F = mesh;
# ---------- end c_script_3 ----------
msmooth_2 = SmoothMesh(Mesh=c_script_3.F, Strength=1, SkipNaked=False, Iterations=1)
panel_7 = Panel(c_script_3.C)
avr_6 = Average(Input=c_script_3.C)
# 25 = 0.1pi
# 100 = 1pi
# Abs(dif) = U:V ratio (1=U, 0=V)
panel_8 = Panel(avr_6)
panel_9 = Panel(c_script_3.A)
avr_7 = Average(Input=c_script_3.A)
panel_10 = Panel(avr_7)
panel_11 = Panel(c_script_3.B)
avr_8 = Average(Input=c_script_3.B)
panel_12 = Panel(avr_8)

# ==== cluster SpringsFromMesh: Turns all edges of a mesh into springs
M = ClusterInput()
medges = MeshEdges(Mesh=M)  # -> NakedEdges, InteriorEdges, NonManifoldEdges
crv = Curve([medges.NakedEdges, medges.InteriorEdges])
B = ClusterInput()
len = Length(Curve=crv)
multiplication = Multiplication(A=len, B=B)
stiffness = ClusterInput()
unresolved_proxy = ClusterOutput(<missing>)
