# Grasshopper definition finaltopo112617_2321.gh (Grasshopper 0.9.76)

# Master V angle slider
# (for testing)
v_angle = Slider(0, range=-2..2)  # disabled
# Master V angle slider
# (for testing)
v_angle_2 = Slider(0, range=-1..1)
# Create plane at origin
pt = ConstructPoint(XCoordinate=0, YCoordinate=30, ZCoordinate=0)  # disabled
pl = ConstructPlane(Origin=pt, XAxis=Vector(1, 0, 0), YAxis=Vector(0, 1, 0))  # disabled
panel = Panel("0.0")  # disabled
pt_2 = ConstructPoint(XCoordinate=0, YCoordinate=0, ZCoordinate=0)
u_angle = Slider(0, range=0..2)  # disabled
v_angle_3 = Slider(0, range=0..2)  # disabled
pl_2 = ConstructPlane(Origin=pt_2, XAxis=Vector(1, 0, 0), YAxis=Vector(0, 1, 0))
v_angle_4 = Slider(0.6, range=0..2)
v_angle_5 = Slider(0.6, range=0..2)
v_angle_6 = Slider(0.6, range=0..2)
u_angle_2 = Slider(0, range=0..2)
u_angle_3 = Slider(0, range=0..2)
u_angle_4 = Slider(0, range=0..2)
panel_2 = Panel(v_angle)  # disabled
c_script = CSharpScript(origin=pl_2)  # -> out, A, B, C; inputs origin: Point3d
# ---------- c_script: C# ----------
    Vector3d v = new Vector3d(10, 0, 0);
    Vector3d u = new Vector3d(0, 10, 0);

    Vector3d z = new Vector3d(0, 0, 1);

    // Point3d p = new Point3d(0, 0, 0);
    Point3d p1 = new Point3d(0, 0, 0);

    Plane plane = new Plane(origin, z);
    Plane plane2 = new Plane(origin, z);

    Transform motion = Transform.Translation(v);

    p1.Transform(motion);
    plane2.Transform(motion);

    Vector3d prev = new Vector3d(0, 0, 0);
    prev = p1 - origin;


    // plane nextplane = new plane (p1, rightangletopreviousline)

    // Dim WA As Transform = Transform.ChangeBasis(Plane.WorldXY, plnList1(i))
    // Dim BW As Transform = Transform.ChangeBasis(plnList2(i), Plane.WorldXY)
    // Dim XF As Transform = BW * WA


    A = origin;
    B = p1;
    C = plane2;
# ---------- end c_script ----------
# Create plane at origin
pt_3 = ConstructPoint(XCoordinate=0, YCoordinate=15, ZCoordinate=0)
u_angle_5 = Slider(0, range=0..2)  # disabled
expression = Expression(prevU=panel, U=u_angle, nextU=u_angle_5, Expression="(prevU*.25)+(U*.5)+(nextU*.25)")  # disabled
v_angle_7 = Slider(0, range=0..2)  # disabled
pl_3 = ConstructPlane(Origin=pt_3, XAxis=Vector(1, 0, 0), YAxis=Vector(0, 1, 0))
cluster = Cluster(P=pl_3, U=u_angle_2, V=v_angle_2)
cluster_2 = Cluster(P=cluster, U=u_angle_3, V=v_angle_2)
cluster_3 = Cluster(P=cluster_2, U=u_angle_4, V=v_angle_2)
# Create vertice for fabric
# edge (for representation
# only, has no sensor value)
fabric_edge = FabricEdge(P=cluster_3)
# Move in opposite direction
rotate_pl_180 = RotatePl180(G=pl_3)
# Create vertice for fabric
# edge (for representation
# only, has no sensor value)
fabric_edge_2 = FabricEdge(P=rotate_pl_180)
panel_3 = Panel(v_angle)  # disabled
expression_2 = Expression(prevV=panel, V=panel_2, nextV=panel_3, Expression="(prevV*.25)+(V*.5)+(nextV*.25)")  # disabled
pt_4 = PointPolar(BasePlane=pl, XYAngle=expression, ZAngle=expression_2, Offset=10)  # disabled
vec2pt = Vector2Pt(PointA=pl, PointB=pt_4, Unitize=False)  # -> Vector, Length; disabled
pl_4 = ConstructPlane(Origin=pt_4, XAxis=vec2pt.Vector, YAxis=Vector(0, 1, 0))  # disabled
pline = PolyLine(Vertices=[fabric_edge_2, pl_3, cluster, cluster_2, cluster_3, fabric_edge], Closed=False)
panel_4 = Panel("0.0")  # disabled
u_angle_6 = Slider(0, range=0..2)  # disabled
# All components above disabled
expression_3 = Expression(prevU=u_angle, U=u_angle_5, nextU=u_angle_6, Expression="(prevU*.25)+(U*.5)+(nextU*.25)")  # disabled
v_angle_8 = Slider(0, range=0..2)  # disabled
panel_5 = Panel(v_angle)  # disabled
expression_4 = Expression(prevV=panel_2, V=panel_3, nextV=panel_5, Expression="(prevV*.25)+(V*.5)+(nextV*.25)")  # disabled
pt_5 = PointPolar(BasePlane=pl_4, XYAngle=expression_3, ZAngle=expression_4, Offset=10)  # disabled
vec2pt_2 = Vector2Pt(PointA=pt_4, PointB=pt_5, Unitize=False)  # -> Vector, Length; disabled
pl_5 = ConstructPlane(Origin=pt_5, XAxis=vec2pt_2.Vector, YAxis=Vector(0, 1, 0))  # disabled
expression_5 = Expression(prevV=panel_3, V=panel_5, nextV=panel_4, Expression="(prevV*.25)+(V*.5)+(nextV*.25)")  # disabled
pt_6 = PointPolar(BasePlane=pl_5, XYAngle=u_angle_6, ZAngle=expression_5, Offset=10)  # disabled
pt_7 = Point([pl, pt_4, pt_5, pt_6])  # disabled
pline_2 = PolyLine(Vertices=pt_7, Closed=False)  # disabled
vec2pt_3 = Vector2Pt(PointA=pt_5, PointB=pt_6, Unitize=False)  # -> Vector, Length; disabled
pl_6 = ConstructPlane(Origin=pt_6, XAxis=vec2pt_3.Vector, YAxis=Vector(0, 1, 0))  # disabled

# ==== cluster Cluster
V = ClusterInput()
U = ClusterInput()
# This is the point/plane
# of the previous grid point
P = ClusterInput()
expression = Expression(prevU="0.0", U=U, nextU="0.0", Expression="(prevU*0.0)+(U*1.0)+(nextU*0.0)")
expression_2 = Expression(prevV="0.0", V=V, nextV="0.0", Expression="(prevV*0.0)+(V*1.0)+(nextV*0.0)")
pi = Pi(Factor=1)
pi_2 = Pi(Factor=1)
multiplication = Multiplication(A=pi, B=expression)
multiplication_2 = Multiplication(A=expression_2, B=pi_2)
# Create new point from
# origin of previous plane,
# plus fixed distance (10),
# rotated by U and V
pt = PointPolar(BasePlane=P, XYAngle=multiplication, ZAngle=multiplication_2, Offset=10)
# Get vector from previous
# grid point to next
vec2pt = Vector2Pt(PointA=P, PointB=pt, Unitize=False)  # -> Vector, Length
# Create input plane
# for next cluster
pl = ConstructPlane(Origin=pt, XAxis=vec2pt.Vector, YAxis=Vector(0, 1, 0))
pl_2 = ClusterOutput(pl)

# ==== cluster FabricEdge
U = ClusterInput()
V = ClusterInput()
# This is the point/plane
# of the previous grid point
P = ClusterInput()
expression = Expression(prevU="0.0", U="0.0", nextU="0.0", Expression="(prevU*0.0)+(U*1.0)+(nextU*0.0)")
expression_2 = Expression(prevV="0.0", V="0.0", nextV="0.0", Expression="(prevV*.00)+(V*1.0)+(nextV*.00)")
pi = Pi(Factor=1)
pi_2 = Pi(Factor=1)
multiplication = Multiplication(A=pi, B=expression)
multiplication_2 = Multiplication(A=expression_2, B=pi_2)
# Create new point from
# origin of previous plane,
# plus fixed distance (10),
# rotated by U and V
pt = PointPolar(BasePlane=P, XYAngle=multiplication, ZAngle=multiplication_2, Offset=2)
# Get vector from previous
# grid point to next
vec2pt = Vector2Pt(PointA=P, PointB=pt, Unitize=False)  # -> Vector, Length
# Create input plane
# for next cluster
pl = ConstructPlane(Origin=pt, XAxis=vec2pt.Vector, YAxis=Vector(0, 1, 0))
pl_2 = ClusterOutput(pl)

# ==== cluster RotatePl180
rotation = Slider(1, range=0..2)
pi = Pi(Factor=1)
G = ClusterInput()
multiplication = Multiplication(A=rotation, B=pi)
rotate = Rotate(Geometry=G, Angle=multiplication, Plane=G)  # -> Geometry, Transform
G_2 = ClusterOutput(rotate.Geometry)
