# Grasshopper definition finaltopo120317_1630.gh (Grasshopper 0.9.76)
# plug-ins: Kangaroo2 Components

# Master V angle slider
# (for testing)
v_angle = Slider(0.2, range=-1..1)  # disabled
pt = ConstructPoint(XCoordinate=0, YCoordinate=0, ZCoordinate=0)
pi = Pi(Factor=1)
pi_2 = Pi(Factor=1)
pl = ConstructPlane(Origin=pt, XAxis=Vector(1, 0, 0), YAxis=Vector(0, 1, 0))
multiplication = Multiplication(A=Slider(0, range=-1..1), B=pi)
multiplication_2 = Multiplication(A=Slider(0, range=-1..1), B=pi_2)
v_angle_2 = Slider(0.6, range=0..2)  # disabled
v_angle_3 = Slider(0.6, range=0..2)  # disabled
v_angle_4 = Slider(0.6, range=0..2)  # disabled
u_angle = Slider(0, range=0..2)  # disabled
u_angle_2 = Slider(0, range=0..2)  # disabled
u_angle_3 = Slider(0, range=0..2)  # disabled
c_script = CSharpScript(origin=pl, vVal=multiplication, uVal=multiplication_2)  # -> out, A, B, C, D, E, F, G; inputs origin: Point3d, vVal: Double, uVal: Double
# ---------- c_script: C# ----------
    double gridSize = 10.0;
    Vector3d v = new Vector3d(gridSize, 0, 0); // v offset
    Vector3d u = new Vector3d(0, gridSize, 0); // u offset
    Vector3d z = new Vector3d(0, 0, 1); // normal z for origin plane
    // Point3d "origin" is instantiated as input
    Plane plane = new Plane(origin, z); // plane at "origin"

    Vector3d localU = new Vector3d(u);
    Vector3d localV = new Vector3d(v);

    List<double> vVals = new List<double>();
    List<double> uVals = new List<double>();

    // initialize fake u v curvature values from input
    for(int i = 0; i < 64; ++i) {
      vVals.Add(vVal);
    }
    for(int i = 0; i < 64; ++i) {
      uVals.Add(uVal);
    }

    // current state init
    Point3d pC = new Point3d(0, 0, 0);
    Plane planeC = new Plane(origin, z);
    Vector3d vectorC = new Vector3d(v);
    Vector3d vectorCU = new Vector3d(u);
    Transform motion = Transform.Translation(v);

    // next state init
    Point3d pNV = new Point3d(0, 0, 0);
    Plane planeNV = new Plane(origin, z);
    Vector3d vectorNV = new Vector3d(0, 0, 0);
    Point3d pNU = new Point3d(0, 0, 0);
    Plane planeNU = new Plane(origin, z);
    Vector3d vectorNU = new Vector3d(0, 0, 0);
    Plane planeUtemp = new Plane(origin, z);
    Plane planeVtemp = new Plane(origin, z);

    // output init
    List<Plane> planes = new List<Plane>();
    List<Plane> planes2 = new List<Plane>();
    for(int i = 0; i < 64; ++i) {
      Plane ptemp = new Plane(origin, z);
      planes.Add(ptemp);
    }
    // planes.Add(plane); // add origin plane
    //planes[0] = plane;

    //int j = 0;

    for(int i = 0; i < 8; ++i) {

      planeNV = planeC;
      pNV = pC + vectorC;
      vectorNV = pNV - pC;
      vectorNV.Rotate(vVals[i], planeC.YAxis);
      motion = Transform.Translation(vectorNV);
      if (i > 0){
        planeNV.Transform(motion);
        pNV.Transform(motion);
        planeNV.Rotate(vVals[i], planeC.YAxis);
      }
      planes[i] = planeNV;

      // reset current vars
      planeC = planeNV;
      vectorC = vectorNV;
      pC = pNV;

    }

    double tempout = 0.0;
    double tempout2 = 0.0;
    Vector3d tempvec = new Vector3d(0, 0, 0);
    Plane tempplane1 = new Plane(origin, z);
    Plane tempplane2 = new Plane(origin, z);
    Plane tempplane3 = new Plane(origin, z);
    Point3d pTemp = new Point3d(0, 0, 0);

    for(int j = 0; j < 7; j++) {

      // reset current to planes[i] for each row
      vectorC = new Vector3d(v);

      if (j == 0){
        pC = planes[j * 8].Origin;
        planeC = planes[j * 8];
        vectorCU = u;
      } else {
        pC = planes[j * 8].Origin;
        planeC = planes[j * 8];
        vectorCU = planeC.Origin - planes[((j - 1) * 8)].Origin;
      }

      for(int i = 0; i < 8; ++i) {

        // create new plane in u
        planeNU = planeC;
        Plane planeCU = planeC;
        pNU = pC + vectorCU;
        vectorNU = pNU - pC;
        vectorNU.Rotate(uVals[(j * 8) + 8 + i], planeC.XAxis);
        motion = Transform.Translation(vectorNU);
        planeNU.Transform(motion);
        pNU.Transform(motion);
        planeNU.Rotate(uVals[(j * 8) + 8 + i], planeC.XAxis);
        planes[(j * 8) + 8 + i] = planeNU;

        // reconcile with previous, if no previous skip
        if (i == 0){
          //do nothing
        }else{
          //previous is [7+i]
          // do v extension from previous
          vectorC = planes[(j * 8) + 7 + i].Origin - planes[(j * 8) + 6 + i].Origin; // skipping 0, still true? --> needs to be vector in v prior, which doesn't exist
          planeC = planes[(j * 8) + 6 + i];
          pC = planeC.Origin;

          planeNV = planes[(j * 8) + 7 + i];
          pNV = pC + vectorC;
          vectorNV = pNV - pC;
          vectorNV.Rotate(vVals[(j * 8) + 8 + i], planeC.YAxis);
          motion = Transform.Translation(vectorNV);
          planeNV.Transform(motion);
          pNV.Transform(motion);
          planeNV.Rotate(vVals[(j * 8) + 8 + i], planeC.YAxis);
          planeVtemp = planeNV;


          // find midpoint (should be more constrained...) btwn plane[8 + i] and planeVtemp

          Vector3d tween = planes[(j * 8) + 8 + i].Origin - planeVtemp.Origin;
          tween = tween * 0.5;
          motion = Transform.Translation(tween);
          //planes[(j * 8) + 8 + i].Transform(motion);

          // constrain for developability
          // best guess from v is planeVtemp
          // best guess from U is planes[(j * 8) + 8 + i]
          // v-1 neighbor is planes[(j * 8) + 7 + i]
          // u-1 neighbor is planes[((j-1) * 8) + 8 + i]
          Plane prevU = planes[(j * 8) + i];
          Plane prevV = planes[(j * 8) + 7 + i];
          // get midpoint of prevV and prevU origins
          tween = (prevV.Origin - prevU.Origin) * 0.5;
          // if ((mean curvature from prevU and prevV toward current)
          // is greater curvature from origin to prevV, then fold along
          // -V+U to +V-U, else fold along -V-U to +V+U
          double prevVcurv = Vector3d.VectorAngle(planeC.XAxis, vectorNV); // dot product
          double prevUcurv = Vector3d.VectorAngle(planeCU.YAxis, vectorNU); // dot product
          double meancurrent = (prevVcurv + prevUcurv) / 2;
          //tempout = meancurrent;

          Plane prevOrigin = planes[(j * 8) + i - 1];
          Vector3d originUvec = prevV.Origin - prevOrigin.Origin;
          double originUcurv = Vector3d.VectorAngle(prevOrigin.YAxis, originUvec);

          // probably have to both planes in current row
          if (Math.Abs(originUcurv) > Math.Abs(meancurrent)){
            // fold along origin to ++
            tempout = Math.Abs(originUcurv);
            tempout2 = Math.Abs(meancurrent);

          } else {
            tempplane1 = prevV;
            tempplane2 = prevU;
            tempplane3 = prevOrigin;
            pTemp = prevV.Origin;


            // fold along +U-V to +V-U
            // translate prevV to
            Plane tmpOrigin = prevOrigin;

            //motion = Transform.Translation(vectorNU);
            tmpOrigin.Rotate(vVals[(j * 8) + i], tmpOrigin.YAxis);
            tmpOrigin.Rotate(uVals[(j * 8) + i], tmpOrigin.XAxis);
            tempplane3 = tmpOrigin;

            Plane tmpOrigin2 = tmpOrigin;
            //Transform p2p = Transform.PlaneToPlane(prevOrigin, tmpOrigin);
            tempvec = planes[(j * 8) + i + 7].Origin - prevOrigin.Origin;
            motion = Transform.Translation(tempvec);
            tmpOrigin2.Transform(motion);


            //tmpOrigin2.Transform(p2p); // tmpOrigin, tempOrigin2 and PrevU now form a triangle on the current plane
            // now take the mean curvature of both prevs and rotate them around the hypotenuse
            tempplane1 = tmpOrigin2;

            prevV = tmpOrigin2;// tmpOrigin, prevV and PrevU form triangle
            Vector3d hypotenuse = prevU.Origin - prevV.Origin;
            tempvec = hypotenuse;

            // vectorNV is the zero point and vectorNU/2 the rotation around hypotenuse
            planeVtemp.Rotate(uVals[(j * 8) + 8 + i] / 2, hypotenuse);
            planes2.Add(planeVtemp);
            //planes[(j * 8) + 8 + i] = planeVtemp;
            //planes[(j * 8) + 8 + i]

            tempplane1 = prevV;
            tempplane2 = prevU;
            tempplane3 = planeVtemp;
            pTemp = prevV.Origin;





            tempout = Math.Abs(originUcurv);
            tempout2 = Math.Abs(meancurrent);



          }




        }

        // reset current plane to next plane along v

        planeC = planes[(j * 8) + i + 1];
        pC = planes[(j * 8) + i + 1].Origin;
        if (j == 0) {
          vectorCU = u;
        } else {
          vectorCU = planeC.Origin - planes[((j - 1) * 8) + i + 1].Origin;
        }

      }



    }

    double globalCost = 0.0;
    for(int j = 1; j < 8; ++j) {

      for(int i = 1; i < 8; ++i) {

        Plane topright = planes[(j * 8) + i];
        Plane topleft = planes[(j * 8) + i - 1];
        Plane bottomleft = planes[((j - 1) * 8) + i - 1];
        Plane bottomright = planes[((j - 1) * 8) + i];

        double top = (topright.Origin - topleft.Origin).Length;
        double left = (topleft.Origin - bottomleft.Origin).Length;
        double right = (topright.Origin - bottomright.Origin).Length;
        double bottom = (bottomright.Origin - bottomleft.Origin).Length;
        double diag1 = (topleft.Origin - bottomright.Origin).Length;
        double diag2 = (topright.Origin - bottomleft.Origin).Length;

        globalCost += Math.Abs(gridSize - top);
        globalCost += Math.Abs(gridSize - left);
        globalCost += Math.Abs(gridSize - right);
        globalCost += Math.Abs(gridSize - bottom);
        globalCost += Math.Abs(Math.Sqrt(2 * Math.Pow(gridSize, 2)) - diag1);
        globalCost += Math.Abs(Math.Sqrt(2 * Math.Pow(gridSize, 2)) - diag2);



      }

    }

    // calculate self-intersection penalty in v direction
    double SIcost = 0.0;
    for(int j = 0; j < 8; ++j) {
      for(int i = 0; i < 8; ++i) {
        // i how many we can look back
        int count = 0;
        double total = 0.0;
        for (int h = 1; h <= i; ++h) {

          total += vVals[(j * 8) + i - h] / Math.PI;
          if (count > 0) {
            if (total > 2 - (2 / (count + 1))) {
              SIcost += 10000;
              break;
            }
          }
          count++;

        }
      }
    }

    // calculate self-intersection penalty in v direction
    for(int j = 0; j < 8; ++j) {
      for(int i = 0; i < 8; ++i) {
        // i how many we can look back
        int count = 0;
        double total = 0.0;
        for (int h = 1; h <= i; ++h) {

          total += uVals[((i - h) * 8) + j] / Math.PI;
          if (count > 0) {
            if (total > 2 - (2 / (count + 1))) {
              SIcost += 10000;
              break;
            }
          }
          count++;

        }
      }
    }


    A = planes;
    B = tempvec; // hypotenuse
    C = tempplane1;
    D = tempplane2;
    E = planes2;
    F = SIcost;
    G = globalCost;
# ---------- end c_script ----------
# Create plane at origin
pt_2 = ConstructPoint(XCoordinate=0, YCoordinate=15, ZCoordinate=0)  # disabled
panel = Panel(c_script.G)
panel_2 = Panel(c_script.F)
item = ListItem(List=c_script.A, Index=Slider(7, range=0..63), Wrap=True)
pln = Plane(c_script.E)
pln_2 = Plane(c_script.A)
pln_3 = Plane(c_script.C)
vdis = VectorDisplay(Anchor=pln_3, Vector=c_script.B)
pln_4 = Plane(c_script.D)
pl_2 = ConstructPlane(Origin=pt_2, XAxis=Vector(1, 0, 0), YAxis=Vector(0, 1, 0))  # disabled
cluster = Cluster(P=pl_2, U=u_angle, V=v_angle)  # disabled
cluster_2 = Cluster(P=cluster, U=u_angle_2, V=v_angle)  # disabled
cluster_3 = Cluster(P=cluster_2, U=u_angle_3, V=v_angle)  # disabled
# Create vertice for fabric
# edge (for representation
# only, has no sensor value)
fabric_edge = FabricEdge(P=cluster_3)  # disabled
# Move in opposite direction
rotate_pl_180 = RotatePl180(G=pl_2)  # disabled
# Create vertice for fabric
# edge (for representation
# only, has no sensor value)
fabric_edge_2 = FabricEdge(P=rotate_pl_180)  # disabled
pline = PolyLine(Vertices=[fabric_edge_2, pl_2, cluster, cluster_2, cluster_3, fabric_edge], Closed=False)  # disabled
pt_3 = ConstructPoint(XCoordinate=0, YCoordinate=100, ZCoordinate=0)
item_2 = ListItem(Index=0, Wrap=True)  # disabled
pi_3 = Pi(Factor=1)
pi_4 = Pi(Factor=1)
number_slider = Slider(100, range=0..100)  # disabled
# Master V angle slider
# (for testing)
v_angle_5 = Slider(0, range=-2..2)  # disabled
pl_3 = ConstructPlane(Origin=pt_3, XAxis=Vector(1, 0, 0), YAxis=Vector(0, 1, 0))
# step size
number_slider_2 = Slider(0.01, range=0..0.02)
hinge = Hinge(Strength=1)  # disabled
# Create plane at origin
pt_4 = ConstructPoint(XCoordinate=0, YCoordinate=30, ZCoordinate=0)  # disabled
panel_3 = Panel("-1 to 1")  # disabled
number_slider_3 = Slider(0, range=0..100)  # disabled
mesh = Mesh(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)  # disabled
pi_5 = Pi(Factor=1)
demesh = DeconstructMesh(Mesh=mesh)  # -> Vertices, Faces, Colours, Normals; disabled
lng = ListLength(List=demesh.Vertices)  # disabled
division = Division(A=lng, B=2)  # disabled
random = Random(Range=lng, Number=division, Seed=2, Integers=True)  # disabled
item_3 = ListItem(List=demesh.Vertices, Index=number_slider, Wrap=True)  # disabled
multiplication_3 = Multiplication(A=Slider(0.1, range=-1..1), B=pi_3)
multiplication_4 = Multiplication(A=Slider(0.1, range=-1..1), B=pi_4)
# Max Iterations
number_slider_4 = Slider(10, range=1..100)
number_slider_5 = Slider(20, range=0..100)  # disabled
c_script_2 = CSharpScript()  # -> out, A
# ---------- c_script_2: C# ----------
    Mesh mesh = new Mesh();

    for(int i = 0; i < 8;i++)
    {
      for (int j = 0; j < 8;j++)
      {

        Point3d p = new Point3d(i * 10, j * 10, 0.0);

        mesh.Vertices.Add(p);
        if (i < 7 && j < 7) {
          p = new Point3d(i * 10 + 5, j * 10 + 5, 0.0);
          //mesh.Vertices.Add(p);
        }

      }
    }

    for(int i = 0; i < 7;i++)
    {
      for (int j = 0; j < 7;j++)
      {

        Point3d p = new Point3d(i * 10 + 5, j * 10 + 5, 0.0);
        mesh.Vertices.Add(p);

      }
    }

    for(int row = 0; row < 56; row += 8)
    {
      for(int col = 0; col < 7; col++)
      {
        //mesh.Faces.AddFace(i + j, i + j + 1, i + 9 + j, i + 8 + j);
        //mesh.Faces.AddFace(row + col, row + col + 1, row + 9 + col, row + 8 + col);
        // zero, one, nine, eight
        if (row < 56 && col < 7){
          mesh.Faces.AddFace(row + col, row + col + 64 - (row / 8), row + col + 1);
          mesh.Faces.AddFace(row + col, row + col + 64 - (row / 8), row + col + 8);
          mesh.Faces.AddFace(row + col + 8, row + col + 64 - (row / 8), row + col + 9);
          mesh.Faces.AddFace(row + col + 1, row + col + 64 - (row / 8), row + col + 9);
        }

      }
    }

    A = mesh;
# ---------- end c_script_2 ----------
pl_4 = ConstructPlane(Origin=pt_4, XAxis=Vector(1, 0, 0), YAxis=Vector(0, 1, 0))  # disabled
multiplication_5 = Multiplication(A=number_slider_2, B=pi_5)
pdecon = Deconstruct(Point=item_3)  # -> XComponent, YComponent, ZComponent; disabled
addition = Addition(A=pdecon.ZComponent, B=number_slider_3)  # disabled
panel_4 = Panel("0.0")  # disabled
mesh_2 = Mesh(c_script_2.A)
nv = NakedVertices(Mesh=mesh)  # -> ClothedIndex, NakedIndex, ClothedPts, NakedPts; disabled
pt_5 = ConstructPoint(XCoordinate=pdecon.XComponent, YCoordinate=pdecon.YComponent, ZCoordinate=addition)  # disabled
replace = ReplaceItems(List=demesh.Vertices, Item=pt_5, Indices=number_slider, Wrap=False)  # disabled
c_script_3 = CSharpScript(origin=pl_3, vVal=multiplication_3, uVal=multiplication_4, x=number_slider_4, step=multiplication_5)  # -> out, A, B, C, D, E, F, G, H; inputs origin: Point3d, vVal: Double, uVal: Double, x: Int32, step: Double
# ---------- c_script_3: C# ----------
    double gridSize = 10.0;

    // initialize fake u v curvature values
    List<double> vVals = new List<double>();
    List<double> uVals = new List<double>();
    for(int i = 0; i < 64; ++i) {
      vVals.Add(vVal); // from slider
      uVals.Add(uVal); // from slider
    }

    List<double> vValsOrig = new List<double>(vVals);
    List<double> uValsOrig = new List<double>(uVals);

    // surface function creates a plane at each grid point as if fabric is perfectly stretchable
    List<Plane> planes = surface(gridSize, origin, vVals, uVals);
    // devcost function calculates how much the surface violates developability, in terms of distances squared
    double devCost = devcost(planes, gridSize);
    // SIcost function calculates penalty for each self-intersection (10,000 points per violation)
    double SIcost = intersectcost(uVals, vVals);
    double angleCost = 0.0;

    double cost = devCost + SIcost + angleCost;

    //double step = 0.01 * Math.PI;

    double count = 0.0;

    //double tempout = 0.0;

    double runningCost = 99999999.0;
    double threshold = 2.0;

    // Gradient Descent to minimize violation of developability and self-intersection
    for(int h = 0; h < x; ++h) {
      if (runningCost < threshold) {
        break;
      }
      for(int i = 0; i < 64; ++i) {
        // perturb u and v by 0.1*PI in both directions and calculate cost reduction, modify uVals/vVals with the winner
        // in other words, perform gradient descent on uVals and vVals
        List<double> tempUvals = new List<double>(uVals);
        List<double> tempUvals2 = new List<double>(uVals);
        List<double> uValsClone = new List<double>(uVals);
        List<double> uValsClone2 = new List<double>(uVals);

        tempUvals[i] = uValsClone[i] - step;
        List<Plane> planesTemp = surface(gridSize, origin, vVals, tempUvals);
        double devCostTemp = devcost(planesTemp, gridSize);
        double SIcostTemp = intersectcost(tempUvals, vVals);
        double angleCostTemp = Math.Pow(Math.Abs(uValsOrig.Sum() - tempUvals.Sum()), 2);
        double costTemp = devCostTemp + SIcostTemp + angleCostTemp;

        tempUvals2[i] = uValsClone2[i] + step;
        List<Plane> planesTemp2 = surface(gridSize, origin, vVals, tempUvals2);
        double devCostTemp2 = devcost(planesTemp2, gridSize);
        double SIcostTemp2 = intersectcost(tempUvals2, vVals);
        double angleCostTemp2 = Math.Pow(Math.Abs(uValsOrig.Sum() - tempUvals2.Sum()), 2);
        double costTemp2 = devCostTemp2 + SIcostTemp2 + angleCostTemp2;

        if (costTemp < costTemp2) {
          if (costTemp < cost){
            uVals = new List<double>(tempUvals);
            runningCost = costTemp;
            count++;
          }
        } else if (costTemp2 < cost) {
          uVals = new List<double>(tempUvals2);
          runningCost = costTemp2;
          count++;
        }

        // perturb u and v by 0.1*PI in both directions and calculate cost reduction, modify uVals/vVals with the winner
        // in other words, perform gradient descent on uVals and vVals
        List<double> tempVvals = new List<double>(vVals);
        List<double> tempVvals2 = new List<double>(vVals);
        List<double> vValsClone = new List<double>(vVals);
        List<double> vValsClone2 = new List<double>(vVals);

        tempVvals[i] = vValsClone[i] - step;
        planesTemp = surface(gridSize, origin, tempVvals, uVals);
        devCostTemp = devcost(planesTemp, gridSize);
        SIcostTemp = intersectcost(uVals, tempVvals);
        angleCostTemp = Math.Pow(Math.Abs(vValsOrig.Sum() - tempVvals.Sum()), 2);
        costTemp = devCostTemp + SIcostTemp + angleCostTemp;

        tempVvals2[i] = vValsClone2[i] + step;
        planesTemp2 = surface(gridSize, origin, tempVvals2, uVals);
        devCostTemp2 = devcost(planesTemp2, gridSize);
        SIcostTemp2 = intersectcost(uVals, tempVvals2);
        angleCostTemp2 = Math.Pow(Math.Abs(vValsOrig.Sum() - tempVvals2.Sum()), 2);
        costTemp2 = devCostTemp2 + SIcostTemp2 + angleCostTemp2;

        if (costTemp < costTemp2) {
          if (costTemp < cost){
            vVals = new List<double>(tempVvals);
            runningCost = costTemp;
            count++;
          }
        } else  if (costTemp2 < cost) {
          vVals = new List<double>(tempVvals2);
          runningCost = costTemp2;
          count++;
        }

      }
    }


    List<Plane> planesOut = surface(gridSize, origin, vVals, uVals);
    double devCostNew = devcost(planesOut, gridSize);
    double SIcostNew = intersectcost(uVals, vVals);

    A = planesOut;
    B = SIcost;
    C = devCost;
    D = SIcostNew;
    E = devCostNew;
    F = uVals;
    G = vVals;
    H = planes;
# ---------- c_script_3: C# additional code ----------
  public static List<Plane> surface(double gridSize, Point3d origin, List<double> vVals, List<double> uVals)
  {
    Vector3d v = new Vector3d(gridSize, 0, 0); // v offset
    Vector3d u = new Vector3d(0, gridSize, 0); // u offset
    Vector3d z = new Vector3d(0, 0, 1); // normal z for origin plane
    // Point3d "origin" is instantiated as input
    Plane plane = new Plane(origin, z); // plane at "origin"

    Vector3d localU = new Vector3d(u);
    Vector3d localV = new Vector3d(v);

    // current state init
    Point3d pC = new Point3d(0, 0, 0);
    Plane planeC = new Plane(origin, z);
    Vector3d vectorC = new Vector3d(v);
    Vector3d vectorCU = new Vector3d(u);
    Transform motion = Transform.Translation(v);

    // next state init
    Point3d pNV = new Point3d(0, 0, 0);
    Plane planeNV = new Plane(origin, z);
    Vector3d vectorNV = new Vector3d(0, 0, 0);
    Point3d pNU = new Point3d(0, 0, 0);
    Plane planeNU = new Plane(origin, z);
    Vector3d vectorNU = new Vector3d(0, 0, 0);
    Plane planeUtemp = new Plane(origin, z);
    Plane planeVtemp = new Plane(origin, z);

    // output init
    List<Plane> planes = new List<Plane>();
    List<Plane> planes2 = new List<Plane>();
    for(int i = 0; i < 64; ++i) {
      Plane ptemp = new Plane(origin, z);
      planes.Add(ptemp);
    }
    // planes.Add(plane); // add origin plane
    //planes[0] = plane;

    //int j = 0;

    for(int i = 0; i < 8; ++i) {



      planeNV = planeC;
      pNV = pC + vectorC;
      vectorNV = pNV - pC;
      vectorNV.Rotate(vVals[i], planeC.YAxis);
      motion = Transform.Translation(vectorNV);
      if (i > 0){
        planeNV.Transform(motion);
        pNV.Transform(motion);
        planeNV.Rotate(vVals[i], planeC.YAxis);
      }
      planes[i] = planeNV;

      // reset current vars
      planeC = planeNV;
      vectorC = vectorNV;
      pC = pNV;

    }

    //double tempout = 0.0;
    //double tempout2 = 0.0;
    Vector3d tempvec = new Vector3d(0, 0, 0);
    Plane tempplane1 = new Plane(origin, z);
    Plane tempplane2 = new Plane(origin, z);
    Plane tempplane3 = new Plane(origin, z);
    Point3d pTemp = new Point3d(0, 0, 0);

    for(int j = 0; j < 7; j++) {

      // reset current to planes[i] for each row
      vectorC = new Vector3d(v);

      if (j == 0){
        pC = planes[j * 8].Origin;
        planeC = planes[j * 8];
        vectorCU = u;
      } else {
        pC = planes[j * 8].Origin;
        planeC = planes[j * 8];
        vectorCU = planeC.Origin - planes[((j - 1) * 8)].Origin;
      }

      for(int i = 0; i < 8; ++i) {

        // create new plane in u
        planeNU = planeC;
        Plane planeCU = planeC;
        pNU = pC + vectorCU;
        vectorNU = pNU - pC;
        vectorNU.Rotate(uVals[(j * 8) + 8 + i], planeC.XAxis);
        motion = Transform.Translation(vectorNU);
        planeNU.Transform(motion);
        pNU.Transform(motion);
        planeNU.Rotate(uVals[(j * 8) + 8 + i], planeC.XAxis);
        planes[(j * 8) + 8 + i] = planeNU;

        // reconcile with previous, if no previous skip
        if (i == 0){
          //do nothing
        }else{
          //previous is [7+i]
          // do v extension from previous
          vectorC = planes[(j * 8) + 7 + i].Origin - planes[(j * 8) + 6 + i].Origin; // skipping 0, still true? --> needs to be vector in v prior, which doesn't exist
          planeC = planes[(j * 8) + 6 + i];
          pC = planeC.Origin;

          planeNV = planes[(j * 8) + 7 + i];
          pNV = pC + vectorC;
          vectorNV = pNV - pC;
          vectorNV.Rotate(vVals[(j * 8) + 8 + i], planeC.YAxis);
          motion = Transform.Translation(vectorNV);
          planeNV.Transform(motion);
          pNV.Transform(motion);
          planeNV.Rotate(vVals[(j * 8) + 8 + i], planeC.YAxis);
          planeVtemp = planeNV;


          // find midpoint (should be more constrained...) btwn plane[8 + i] and planeVtemp

          Vector3d tween = planes[(j * 8) + 8 + i].Origin - planeVtemp.Origin;
          tween = tween * 0.5;
          motion = Transform.Translation(tween);
          planes[(j * 8) + 8 + i].Transform(motion);

        }

        // reset current plane to next plane along v

        planeC = planes[(j * 8) + i + 1];
        pC = planes[(j * 8) + i + 1].Origin;
        if (j == 0) {
          vectorCU = u;
        } else {
          vectorCU = planeC.Origin - planes[((j - 1) * 8) + i + 1].Origin;
        }

      }

    }

    return planes;
  }

  public static double devcost(List<Plane> planes, double gridSize)
  {
    double globalCost = 0.0;
    //double gridSize = 10.0;

    for(int j = 1; j < 8; ++j) {

      for(int i = 1; i < 8; ++i) {

        Plane topright = planes[(j * 8) + i];
        Plane topleft = planes[(j * 8) + i - 1];
        Plane bottomleft = planes[((j - 1) * 8) + i - 1];
        Plane bottomright = planes[((j - 1) * 8) + i];

        double top = (topright.Origin - topleft.Origin).Length;
        double left = (topleft.Origin - bottomleft.Origin).Length;
        double right = (topright.Origin - bottomright.Origin).Length;
        double bottom = (bottomright.Origin - bottomleft.Origin).Length;
        double diag1 = (topleft.Origin - bottomright.Origin).Length;
        double diag2 = (topright.Origin - bottomleft.Origin).Length;

        double localCost = 0.0;
        localCost += Math.Abs(gridSize - top);
        localCost += Math.Abs(gridSize - left);
        localCost += Math.Abs(gridSize - right);
        localCost += Math.Abs(gridSize - bottom);
        double diagCost1 = Math.Abs(Math.Sqrt(2 * Math.Pow(gridSize, 2)) - diag1);
        double diagCost2 = Math.Abs(Math.Sqrt(2 * Math.Pow(gridSize, 2)) - diag2);
        if (diagCost1 < diagCost2) {
          localCost += diagCost1;
        } else {
          localCost += diagCost2;
        }

        // square the local cost
        globalCost += Math.Pow(localCost, 2);


      }

    }
    globalCost = globalCost / 49;

    return globalCost;
  }

  public static double intersectcost(List<double> uVals, List<double> vVals)
  {
    double SIcost = 0.0;
    for(int j = 0; j < 8; ++j) {
      for(int i = 0; i < 8; ++i) {
        // i how many we can look back
        int count = 0;
        double total = 0.0;
        for (int h = 1; h <= i; ++h) {

          total += vVals[(j * 8) + i - h] / Math.PI;
          if (count > 0) {
            if (Math.Abs(total) > 2 - (2 / (count + 1))) {
              SIcost += Math.Pow(total * 10, 2);
              break;
            }
          }
          count++;

        }
      }
    }

    // calculate self-intersection penalty in v direction
    for(int j = 0; j < 8; ++j) {
      for(int i = 0; i < 8; ++i) {
        // i how many we can look back
        int count = 0;
        double total = 0.0;
        for (int h = 1; h <= i; ++h) {

          total += uVals[((i - h) * 8) + j] / Math.PI;
          if (count > 0) {
            if (Math.Abs(total) > 2 - (2 / (count + 1))) {
              SIcost += Math.Pow(total * 10, 2);
              break;
            }
          }
          count++;

        }
      }
    }

    return SIcost;
  }
# ---------- end c_script_3 ----------
random_2 = Random(Range=panel_3, Number=1, Seed=number_slider_5)  # disabled
medges = MeshEdges(Mesh=mesh)  # -> NakedEdges, InteriorEdges, NonManifoldEdges; disabled
u_angle_4 = Slider(0, range=0..2)  # disabled
v_angle_6 = Slider(0, range=0..2)  # disabled
conmesh = ConstructMesh(Vertices=replace, Faces=demesh.Faces)  # disabled
medges_2 = MeshEdges(Mesh=conmesh)  # -> NakedEdges, InteriorEdges, NonManifoldEdges; disabled
panel_5 = Panel(v_angle_5)  # disabled
anchor = Anchor(Point=pt_5, Strength=10000)  # disabled
crv = Curve([medges_2.NakedEdges, medges_2.InteriorEdges])  # disabled
crv_2 = Curve([medges.NakedEdges, medges.InteriorEdges])  # disabled
# Self-Intersection Penalty
# Developability Penalty
panel_6 = Panel(c_script_3.C)
panel_7 = Panel(c_script_3.B)
# Reduced Self-Intersection Penalty
panel_8 = Panel(c_script_3.D)
# Reduced Developability Penalty
panel_9 = Panel(c_script_3.E)
stepsolver = StepSolver(Tolerance=0.01, Momentum=False, Damping=0.99, SubIterations=10)  # -> I, V, O; disabled
item_4 = ListItem(List=c_script_3.A, Index=Slider(0, range=0..63), Wrap=True)
# Use Alt+left mouse button
# to drag vertices in Rhino
grab = Grab(On=True, Strength=1, Range=3)  # -> Grab, Anchors; disabled
reset = Button()  # disabled
pln_5 = Plane(c_script_3.A)
vec = VectorXYZ(XComponent=0, YComponent=0, ZComponent=0)  # -> Vector, Length; disabled
show = Show(G=conmesh)  # disabled
pln_6 = Plane(c_script_3.H)
length_line = LengthLine(Line=crv, Length=crv_2, Strength=10)  # disabled
u_angle_5 = Slider(0, range=0..2)  # disabled
expression = Expression(prevU=panel_4, U=u_angle_4, nextU=u_angle_5, Expression="(prevU*.25)+(U*.5)+(nextU*.25)")  # disabled
v_angle_7 = Slider(0, range=0..2)  # disabled
panel_10 = Panel(v_angle_5)  # disabled
expression_2 = Expression(prevV=panel_4, V=panel_5, nextV=panel_10, Expression="(prevV*.25)+(V*.5)+(nextV*.25)")  # disabled
pt_6 = PointPolar(BasePlane=pl_4, XYAngle=expression, ZAngle=expression_2, Offset=10)  # disabled
vec2pt = Vector2Pt(PointA=pl_4, PointB=pt_6, Unitize=False)  # -> Vector, Length; disabled
pl_5 = ConstructPlane(Origin=pt_6, XAxis=vec2pt.Vector, YAxis=Vector(0, 1, 0))  # disabled
solver = Solver(GoalObjects=[grab.Grab, show, length_line, anchor], Reset=reset, Threshold=1e-15, Tolerance=0.01, On=True)  # -> I, V, O; disabled
# hard dev constraint
c_script_4 = CSharpScript(origin=pl_3, vVal=multiplication_3, uVal=multiplication_4)  # -> out, A, B, C, D, E, F, G; inputs origin: Point3d, vVal: Double, uVal: Double
# ---------- c_script_4: C# ----------
    double gridSize = 10.0;
    Vector3d v = new Vector3d(gridSize, 0, 0); // v offset
    Vector3d u = new Vector3d(0, gridSize, 0); // u offset
    Vector3d z = new Vector3d(0, 0, 1); // normal z for origin plane
    // Point3d "origin" is instantiated as input
    Plane plane = new Plane(origin, z); // plane at "origin"

    Vector3d localU = new Vector3d(u);
    Vector3d localV = new Vector3d(v);

    List<double> vVals = new List<double>();
    List<double> uVals = new List<double>();

    // initialize fake u v curvature values from input
    for(int i = 0; i < 64; ++i) {
      vVals.Add(vVal);
    }
    for(int i = 0; i < 64; ++i) {
      uVals.Add(uVal);
    }

    // current state init
    Point3d pC = new Point3d(0, 0, 0);
    Plane planeC = new Plane(origin, z);
    Vector3d vectorC = new Vector3d(v);
    Vector3d vectorCU = new Vector3d(u);
    Transform motion = Transform.Translation(v);

    // next state init
    Point3d pNV = new Point3d(0, 0, 0);
    Plane planeNV = new Plane(origin, z);
    Vector3d vectorNV = new Vector3d(0, 0, 0);
    Point3d pNU = new Point3d(0, 0, 0);
    Plane planeNU = new Plane(origin, z);
    Vector3d vectorNU = new Vector3d(0, 0, 0);
    Plane planeUtemp = new Plane(origin, z);
    Plane planeVtemp = new Plane(origin, z);

    // output init
    List<Plane> planes = new List<Plane>();
    List<Plane> planes2 = new List<Plane>();
    for(int i = 0; i < 64; ++i) {
      Plane ptemp = new Plane(origin, z);
      planes.Add(ptemp);
    }
    // planes.Add(plane); // add origin plane
    //planes[0] = plane;

    //int j = 0;

    for(int i = 0; i < 8; ++i) {



      planeNV = planeC;
      pNV = pC + vectorC;
      vectorNV = pNV - pC;
      vectorNV.Rotate(vVals[i], planeC.YAxis);
      motion = Transform.Translation(vectorNV);
      if (i > 0){
        planeNV.Transform(motion);
        pNV.Transform(motion);
        planeNV.Rotate(vVals[i], planeC.YAxis);
      }
      planes[i] = planeNV;

      // reset current vars
      planeC = planeNV;
      vectorC = vectorNV;
      pC = pNV;

    }

    double tempout = 0.0;
    double tempout2 = 0.0;
    Vector3d tempvec = new Vector3d(0, 0, 0);
    Plane tempplane1 = new Plane(origin, z);
    Plane tempplane2 = new Plane(origin, z);
    Plane tempplane3 = new Plane(origin, z);
    Point3d pTemp = new Point3d(0, 0, 0);

    for(int j = 0; j < 7; j++) {

      // reset current to planes[i] for each row
      vectorC = new Vector3d(v);

      if (j == 0){
        pC = planes[j * 8].Origin;
        planeC = planes[j * 8];
        vectorCU = u;
      } else {
        pC = planes[j * 8].Origin;
        planeC = planes[j * 8];
        vectorCU = planeC.Origin - planes[((j - 1) * 8)].Origin;
      }

      for(int i = 0; i < 8; ++i) {

        // create new plane in u
        planeNU = planeC;
        Plane planeCU = planeC;
        pNU = pC + vectorCU;
        vectorNU = pNU - pC;
        vectorNU.Rotate(uVals[(j * 8) + 8 + i], planeC.XAxis);
        motion = Transform.Translation(vectorNU);
        planeNU.Transform(motion);
        pNU.Transform(motion);
        planeNU.Rotate(uVals[(j * 8) + 8 + i], planeC.XAxis);
        planes[(j * 8) + 8 + i] = planeNU;

        // reconcile with previous, if no previous skip
        if (i == 0){
          //do nothing
        }else{
          //previous is [7+i]
          // do v extension from previous
          vectorC = planes[(j * 8) + 7 + i].Origin - planes[(j * 8) + 6 + i].Origin; // skipping 0, still true? --> needs to be vector in v prior, which doesn't exist
          planeC = planes[(j * 8) + 6 + i];
          pC = planeC.Origin;

          planeNV = planes[(j * 8) + 7 + i];
          pNV = pC + vectorC;
          vectorNV = pNV - pC;
          vectorNV.Rotate(vVals[(j * 8) + 8 + i], planeC.YAxis);
          motion = Transform.Translation(vectorNV);
          planeNV.Transform(motion);
          pNV.Transform(motion);
          planeNV.Rotate(vVals[(j * 8) + 8 + i], planeC.YAxis);
          planeVtemp = planeNV;


          // find midpoint (should be more constrained...) btwn plane[8 + i] and planeVtemp

          Vector3d tween = planes[(j * 8) + 8 + i].Origin - planeVtemp.Origin;
          tween = tween * 0.5;
          motion = Transform.Translation(tween);
          planes[(j * 8) + 8 + i].Transform(motion);

        }

        // reset current plane to next plane along v

        planeC = planes[(j * 8) + i + 1];
        pC = planes[(j * 8) + i + 1].Origin;
        if (j == 0) {
          vectorCU = u;
        } else {
          vectorCU = planeC.Origin - planes[((j - 1) * 8) + i + 1].Origin;
        }

      }

    }

    double globalCost = 0.0;
    for(int j = 1; j < 8; ++j) {

      for(int i = 1; i < 8; ++i) {

        Plane topright = planes[(j * 8) + i];
        Plane topleft = planes[(j * 8) + i - 1];
        Plane bottomleft = planes[((j - 1) * 8) + i - 1];
        Plane bottomright = planes[((j - 1) * 8) + i];

        double top = (topright.Origin - topleft.Origin).Length;
        double left = (topleft.Origin - bottomleft.Origin).Length;
        double right = (topright.Origin - bottomright.Origin).Length;
        double bottom = (bottomright.Origin - bottomleft.Origin).Length;
        double diag1 = (topleft.Origin - bottomright.Origin).Length;
        double diag2 = (topright.Origin - bottomleft.Origin).Length;

        double localCost = 0.0;
        localCost += Math.Abs(gridSize - top);
        localCost += Math.Abs(gridSize - left);
        localCost += Math.Abs(gridSize - right);
        localCost += Math.Abs(gridSize - bottom);
        localCost += Math.Abs(Math.Sqrt(2 * Math.Pow(gridSize, 2)) - diag1);
        localCost += Math.Abs(Math.Sqrt(2 * Math.Pow(gridSize, 2)) - diag2);

        // square the local cost
        globalCost += Math.Pow(localCost, 2);


      }

    }

    // calculate self-intersection penalty in v direction
    double SIcost = 0.0;
    for(int j = 0; j < 8; ++j) {
      for(int i = 0; i < 8; ++i) {
        // i how many we can look back
        int count = 0;
        double total = 0.0;
        for (int h = 1; h <= i; ++h) {

          total += vVals[(j * 8) + i - h] / Math.PI;
          if (count > 0) {
            if (total > 2 - (2 / (count + 1))) {
              SIcost += 10000;
              break;
            }
          }
          count++;

        }
      }
    }

    // calculate self-intersection penalty in v direction
    for(int j = 0; j < 8; ++j) {
      for(int i = 0; i < 8; ++i) {
        // i how many we can look back
        int count = 0;
        double total = 0.0;
        for (int h = 1; h <= i; ++h) {

          total += uVals[((i - h) * 8) + j] / Math.PI;
          if (count > 0) {
            if (total > 2 - (2 / (count + 1))) {
              SIcost += 10000;
              break;
            }
          }
          count++;

        }
      }
    }


    A = planes;
    B = tempvec; // hypotenuse
    C = tempplane1;
    D = tempplane2;
    E = planes2;
    F = SIcost;
    G = globalCost;
# ---------- end c_script_4 ----------
panel_11 = Panel(solver.O)  # disabled
panel_12 = Panel("0.0")  # disabled
u_angle_6 = Slider(0, range=0..2)  # disabled
# All components above disabled
expression_3 = Expression(prevU=u_angle_4, U=u_angle_5, nextU=u_angle_6, Expression="(prevU*.25)+(U*.5)+(nextU*.25)")  # disabled
v_angle_8 = Slider(0, range=0..2)  # disabled
panel_13 = Panel(v_angle_5)  # disabled
expression_4 = Expression(prevV=panel_5, V=panel_10, nextV=panel_13, Expression="(prevV*.25)+(V*.5)+(nextV*.25)")  # disabled
pt_7 = PointPolar(BasePlane=pl_5, XYAngle=expression_3, ZAngle=expression_4, Offset=10)  # disabled
vec2pt_2 = Vector2Pt(PointA=pt_6, PointB=pt_7, Unitize=False)  # -> Vector, Length; disabled
pl_6 = ConstructPlane(Origin=pt_7, XAxis=vec2pt_2.Vector, YAxis=Vector(0, 1, 0))  # disabled
expression_5 = Expression(prevV=panel_10, V=panel_13, nextV=panel_12, Expression="(prevV*.25)+(V*.5)+(nextV*.25)")  # disabled
pt_8 = PointPolar(BasePlane=pl_6, XYAngle=u_angle_6, ZAngle=expression_5, Offset=10)  # disabled
pt_9 = Point([pl_4, pt_6, pt_7, pt_8])  # disabled
pline_2 = PolyLine(Vertices=pt_9, Closed=False)  # disabled
vec2pt_3 = Vector2Pt(PointA=pt_7, PointB=pt_8, Unitize=False)  # -> Vector, Length; disabled
pl_7 = ConstructPlane(Origin=pt_8, XAxis=vec2pt_3.Vector, YAxis=Vector(0, 1, 0))  # disabled

# ==== cluster Cluster
V = ClusterInput()
U = ClusterInput()
# This is the point/plane
# of the previous grid point
P = ClusterInput()
expression = Expression(prevU="0.0", U=U, nextU="0.0", Expression="(prevU*0.0)+(U*1.0)+(nextU*0.0)")
expression_2 = Expression(prevV="0.0", V=V, nextV="0.0", Expression="(prevV*0.0)+(V*1.0)+(nextV*0.0)")
pi = Pi(Factor=1)
pi_2 = Pi(Factor=1)
multiplication = Multiplication(A=pi, B=expression)
multiplication_2 = Multiplication(A=expression_2, B=pi_2)
# Create new point from
# origin of previous plane,
# plus fixed distance (10),
# rotated by U and V
pt = PointPolar(BasePlane=P, XYAngle=multiplication, ZAngle=multiplication_2, Offset=10)
# Get vector from previous
# grid point to next
vec2pt = Vector2Pt(PointA=P, PointB=pt, Unitize=False)  # -> Vector, Length
# Create input plane
# for next cluster
pl = ConstructPlane(Origin=pt, XAxis=vec2pt.Vector, YAxis=Vector(0, 1, 0))
pl_2 = ClusterOutput(pl)

# ==== cluster FabricEdge
U = ClusterInput()
V = ClusterInput()
# This is the point/plane
# of the previous grid point
P = ClusterInput()
expression = Expression(prevU="0.0", U="0.0", nextU="0.0", Expression="(prevU*0.0)+(U*1.0)+(nextU*0.0)")
expression_2 = Expression(prevV="0.0", V="0.0", nextV="0.0", Expression="(prevV*.00)+(V*1.0)+(nextV*.00)")
pi = Pi(Factor=1)
pi_2 = Pi(Factor=1)
multiplication = Multiplication(A=pi, B=expression)
multiplication_2 = Multiplication(A=expression_2, B=pi_2)
# Create new point from
# origin of previous plane,
# plus fixed distance (10),
# rotated by U and V
pt = PointPolar(BasePlane=P, XYAngle=multiplication, ZAngle=multiplication_2, Offset=2)
# Get vector from previous
# grid point to next
vec2pt = Vector2Pt(PointA=P, PointB=pt, Unitize=False)  # -> Vector, Length
# Create input plane
# for next cluster
pl = ConstructPlane(Origin=pt, XAxis=vec2pt.Vector, YAxis=Vector(0, 1, 0))
pl_2 = ClusterOutput(pl)

# ==== cluster RotatePl180
rotation = Slider(1, range=0..2)
pi = Pi(Factor=1)
G = ClusterInput()
multiplication = Multiplication(A=rotation, B=pi)
rotate = Rotate(Geometry=G, Angle=multiplication, Plane=G)  # -> Geometry, Transform
G_2 = ClusterOutput(rotate.Geometry)
