# Grasshopper definition kinectpts.gh (Grasshopper 0.9.76)
# plug-ins: KinectV23, Firefly.Kinect.V2, Tarsier.Vision

skeleton = KinectV2SkeletonTracker(StartSkeletonTracker=True)  # -> Joints, JointIDs, Bones; disabled
line = Line(skeleton.Bones)
panel = Panel(line)
pt = Point(skeleton.Joints)
depth = Kinect2DepthReader(
    Enable=False,
    Release=False,
    cropping=0,
    depthSet=False,
    detail=1,
    filteringEnabled=False,
    innerBandThreshold=1,
    maxDepth=8000,
    minDepth=0,
    outerBandThreshold=3,
    smoothBufferSize=10,
    smoothingEnabled=False)  # disabled
pt_2 = ConstructPoint(XCoordinate=0, YCoordinate=0, ZCoordinate=0)
panel_2 = Panel(skeleton.JointIDs)
panel_3 = Panel(pt)
owl_kinectv2 = Owl_KinectV2(OriginOfPointcloud=pt_2, ResolutionOfPointcloud=Slider(39, range=0..500), DepthOfPointcloud=Slider(2, range=0..10))  # -> Pointcloud, ColorOfPointcloud; disabled
sph = Sphere(Base=PlaneXY(0, 0, 0), Radius=1)
brep = Brep(<brep referenced from the Rhino model>)
# Head
item = ListItem(List=panel_3, Index=Slider(3, range=0..25), Wrap=True)
# Lefthand
item_2 = ListItem(List=panel_3, Index=Slider(23, range=0..25), Wrap=True)
# righthand
item_3 = ListItem(List=panel_3, Index=Slider(21, range=0..25), Wrap=True)
pt_3 = Point(owl_kinectv2.Pointcloud)
c_script = CSharpScript(pts=owl_kinectv2.Pointcloud, bbox=brep)  # -> out, A; inputs pts: list of Point3d, pln1: Plane, pln2: Plane, bbox: Brep
# ---------- c_script: C# ----------
    List<Point3d> culled = new List<Point3d>();

    for (int i = 0 ; i < pts.Count();i++){
      if(bbox.IsPointInside(pts[i], 0.01, true)){
        culled.Add(pts[i]);
      }
    }

    A = culled;
# ---------- end c_script ----------
pt_4 = Point(item_3)
pt_5 = Point(item_2)
pt_6 = Point(item)
move = Move(Geometry=sph, Motion=pt_6)  # -> Geometry, Transform
pt_7 = Point(c_script.A)
brep_2 = Brep(move.Geometry)
pln = Plane(Plane(origin=(0, 0, 0), x=(0, 0, 1), y=(1, 0, 0)))
handinternal = Mesh(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)
del = DelaunayMesh(Plane=pln)
number_slider = Slider(1, range=0..1)  # disabled
pt_8 = Point([Point(-55.50977707, 693, -194.1202393), Point(-45.39876556, 683, -189.4897156), Point(-35.34519577, 669, -183.810379), Point(-102.5885925, 705.000061, -191.6161804), Point(-91.41492462, 693, -186.5105591), Point(-80.56269073, 681.000061, -181.4667969)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])  # disabled
handptsinternal = Point([Point(-34.76189041, 569, -133.1938019), Point(-27.37149048, 577, -133.5133972), Point(-19.62422943, 581, -132.8715973), Point(-11.62414265, 578, -130.6227417), Point(-3.742528439, 581, -129.7262268), Point(4.179332256, 578, -127.4864502)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])
mesh = Mesh(del)
patch = Patch(Points=pt_8, Spans=20, Flexibility=number_slider, Trim=True)  # disabled
