# Grasshopper definition potentialField (1).gh (Grasshopper 0.9.76)
# plug-ins: millipede2

c_script = CSharpScript(dt=Slider(0.0009, range=0..0.01), reset=Button())  # -> out, A, B, C, D; inputs dt: Double, reset: Boolean
# ---------- c_script: C# ----------
    if (grid == null || reset) {
      grid = new Grid();
    }

    grid.Step(20, dt);
    grid.UpdateU();


    A = grid.p;
    B = grid.g;
    C = grid.u;
    D = grid.m;
# ---------- c_script: C# additional code ----------
  public Grid grid;

  public class GPoint {
    public Point3d p;
    public double u = 0.0;
    public Vector3d g;
    public GPoint [] nx = new GPoint[2];
    public GPoint [] ny = new GPoint[2];
    public bool fix = false;
    public double temp = 0.0;
  }

  public class Grid {
    public Grid() {
      rx = 40;
      ry = 20;
      x0 = 0.0;
      y0 = 0.0;
      x1 = 10.0;
      y1 = 5.0;

      dx = (x1 - x0) / (rx - 1.0);
      dy = (y1 - y0) / (ry - 1.0);

      grid = new GPoint[rx, ry];
      m = Mesh.CreateFromPlane(Plane.WorldXY, new Interval(x0, x1), new Interval(y0, y1), rx - 1, ry - 1);

      p.Clear();
      g.Clear();
      u.Clear();

      for(int j = 0; j < ry;++j) {
        for(int i = 0; i < rx; ++i) {
          GPoint gp = new GPoint();
          gp.p = new Point3d(x0 + i * dx, y0 + j * dy, 0.0);
          gp.g = new Vector3d(gp.p);
          gp.g.Unitize();

          p.Add(gp.p);
          g.Add(gp.g);
          u.Add(gp.u);
          grid[i, j] = gp;
        }
      }

      grid[0, 0].fix = true;

      for(int j = 0; j < ry;++j) {
        for(int i = 0; i < rx; ++i) {
          GPoint gp = grid[i, j];

          if (i == 0)gp.nx[0] = grid[0, j];
          else  gp.nx[0] = grid[i - 1, j];

          if (i == (rx - 1))gp.nx[1] = grid[rx - 1, j];
          else  gp.nx[1] = grid[i + 1, j];


          if (j == 0)gp.ny[0] = grid[i, 0];
          else  gp.ny[0] = grid[i, j - 1];

          if (j == (ry - 1))gp.ny[1] = grid[i, ry - 1];
          else  gp.ny[1] = grid[i, j + 1];
        }
      }
    }

    public void Step(int steps, double dt) {
      for(int k = 0; k < steps; ++k) {
        foreach(GPoint gp in grid) {
          double gx = (gp.nx[1].u - gp.nx[0].u) / dx;
          double gy = (gp.ny[1].u - gp.ny[0].u) / dy;

          double sx = (gx - gp.g.X) * dt;
          double sy = (gy - gp.g.Y) * dt;

          if (!gp.nx[0].fix) gp.nx[0].u += sx;
          if (!gp.nx[1].fix) gp.nx[1].u -= sx;

          if (!gp.ny[0].fix) gp.ny[0].u += sy;
          if (!gp.ny[1].fix) gp.ny[1].u -= sy;
        }
        Smooth();
      }
    }
    
    public void Smooth() {
      foreach(GPoint gp in grid) {
        gp.temp = (gp.u + gp.nx[0].u + gp.nx[1].u + gp.ny[0].u + gp.ny[1].u)*0.2;
      }
      
      foreach(GPoint gp in grid) {
        gp.u = gp.temp;
      }
    }

    public void UpdateU() {
      for(int j = 0; j < ry;++j) {
        for(int i = 0; i < rx; ++i) {
          u[j * rx + i] = (grid[i, j].u);
        }
      }
    }

    public int rx = 20;
    public int ry = 10;
    public double x0 = 0.0;
    public double y0 = 0.0;
    public double x1 = 10.0;
    public double y1 = 5.0;

    public double dx;
    public double dy;

    public List<Point3d> p = new List<Point3d>();
    public List<Vector3d> g = new List<Vector3d>();
    public List<double> u = new List<double>();

    public  GPoint [,] grid;
    public  Mesh m;
  }
# ---------- end c_script ----------
timer = Timer(TimerInterval=20, Target=c_script)  # disabled

bnd = Bounds(Numbers=c_script.C)
vdis = VectorDisplay(Anchor=c_script.A, Vector=c_script.B)

dedomain = DeconstructDomain(Domain=bnd)  # -> Start, End
gradient = Gradient(
    LowerLimit=dedomain.Start,
    UpperLimit=dedomain.End,
    Parameter=c_script.C,
    stops=[0.00731: RGB(41, 155, 255), 0.362: RGB(130, 255, 238), 0.658: RGB(255, 235, 56), 1: RGB(220, 0, 40)])
mcol = MeshColours(Mesh=c_script.D, Colours=gradient)

number_slider = Slider(0.369, range=0..1)
range = Range(Domain=Domain(0, 1), Steps=10)
remap = RemapNumbers(Value=range, Source=Domain(0, 1), Target=bnd)  # -> Mapped, Clipped
mesh_contours = MeshContourField(Mesh=c_script.D, Values=c_script.C, IsoValues=remap.Mapped)
